# Dynamo graph Trim Generator  Single V 1.4.dyn "Auto Trims s v 1.4" (Dynamo 2.16.2.5624)
# author: Yousef Altear
# packages: archi-lab.net 2024.217.1024, Genius Loci 2023.7.13, Rhythm 2023.9.1, GenerativeDesign.Revit 3.0.16.0, Clockwork for Dynamo 2.x 2.6.0, bimorphNodes 5.1.3

# group: Auto Window Trim
# note: Ⓒ Copyright of Script to Paragons Egypt Team

# group: Get Window
s_w_d_single_windows_doors = DSModelElementMutlipleSelection()  # 5 picked in the model; graph input

# group: Window Data
code_block = CodeBlock { "Rough Width"; }
code_block_2 = CodeBlock { "Width"; }
code_block_3 = CodeBlock { "Rough Height"; }
code_block_4 = CodeBlock { "Height"; }

# group: If Condetion
elementType = Revit.LinkElement.ElementType(linkElement=s_w_d_single_windows_doors)
string_from_object = FromObject(object=elementType)
code_block_5 = CodeBlock { "Door"; }
contains = String.Contains(string=string_from_object, searchFor=code_block_5)
countTrue = List.CountTrue(list=contains)
code_block_6 = CodeBlock { 1; }
code_block_7 = CodeBlock(x=countTrue, y=code_block_6) { x>=y; }
if_ = RefactoredIf(test=code_block_7, true=code_block, false=code_block_2)

# group (continued): Window Data
ʳʰʸᵗʰᵐ_elements = Rhythm.Revit.Elements.Elements.GetParameterValueByNameTypeOrInstance(element=s_w_d_single_windows_doors, parameterName=if_)
watch = Watch(ʳʰʸᵗʰᵐ_elements)

# group: If Condetion
elementType_2 = Revit.LinkElement.ElementType(linkElement=s_w_d_single_windows_doors)
string_from_object_2 = FromObject(object=elementType_2)
code_block_8 = CodeBlock { "Door"; }
contains_2 = String.Contains(string=string_from_object_2, searchFor=code_block_8)
countTrue_2 = List.CountTrue(list=contains_2)
code_block_9 = CodeBlock { 1; }
code_block_10 = CodeBlock(x=countTrue_2, y=code_block_9) { x>=y; }
if_2 = RefactoredIf(test=code_block_10, true=code_block_3, false=code_block_4)

# group (continued): Window Data
ʳʰʸᵗʰᵐ_elements_2 = Rhythm.Revit.Elements.Elements.GetParameterValueByNameTypeOrInstance(element=s_w_d_single_windows_doors, parameterName=if_2)
watch_2 = Watch(ʳʰʸᵗʰᵐ_elements_2)

# group: Get Trim
window_trim = DSModelElementSelection()  # 1 picked in the model; graph input
type = archilab.Revit.Elements.Elements.Type(element=window_trim)
element_host = Custom[Element Host](element=s_w_d_single_windows_doors)  # package Genius Loci; Gets the host of the element. Unlike the OOTB node FamilyInstance.GetHost, it also works for elements hosted by a linked document, wall sweeps, foundations, railings and builing pads. Based on a Clockwork's node
code_block_11 = CodeBlock { 1; }

# group: Door Agistment
code_block_12 = CodeBlock { "Top Header Width"; }
ʳʰʸᵗʰᵐ_elements_3 = Rhythm.Revit.Elements.Elements.GetParameterValueByNameTypeOrInstance(element=window_trim, parameterName=code_block_12)
code_block_13 = CodeBlock { 0; }
add = ʳʰʸᵗʰᵐ_elements_3 + code_block_13
string_from_object_3 = FromObject(object=add)
toNumber = String.ToNumber(string=string_from_object_3)
code_block_14 = CodeBlock(x=toNumber) { -x; }
list_create = List.Create(item0=code_block_14)
sum = Math.Sum(values=list_create)
code_block_15 = CodeBlock { "Header Width"; }
ʳʰʸᵗʰᵐ_elements_4 = Rhythm.Revit.Elements.Elements.GetParameterValueByNameTypeOrInstance(element=window_trim, parameterName=code_block_15)
add_2 = ʳʰʸᵗʰᵐ_elements_4 + code_block_13
string_from_object_4 = FromObject(object=add_2)
toNumber_2 = String.ToNumber(string=string_from_object_4)
code_block_16 = CodeBlock { "Rake Header Width"; }
ʳʰʸᵗʰᵐ_elements_5 = Rhythm.Revit.Elements.Elements.GetParameterValueByNameTypeOrInstance(element=window_trim, parameterName=code_block_16)
code_block_17 = CodeBlock { 0; }
add_3 = ʳʰʸᵗʰᵐ_elements_5 + code_block_17
string_from_object_5 = FromObject(object=add_3)
toNumber_3 = String.ToNumber(string=string_from_object_5)
code_block_18 = CodeBlock(x=toNumber_3) { -x; }

# group: Window Agistment
code_block_19 = CodeBlock { "Lower Horizontal Trim Width"; }
ʳʰʸᵗʰᵐ_elements_6 = Rhythm.Revit.Elements.Elements.GetParameterValueByNameTypeOrInstance(element=window_trim, parameterName=code_block_19)
code_block_20 = CodeBlock { 0; }
add_4 = ʳʰʸᵗʰᵐ_elements_6 + code_block_20
string_from_object_6 = FromObject(object=add_4)
toNumber_4 = String.ToNumber(string=string_from_object_6)
code_block_21 = CodeBlock { "Sill Bottom Height"; }
ʳʰʸᵗʰᵐ_elements_7 = Rhythm.Revit.Elements.Elements.GetParameterValueByNameTypeOrInstance(element=window_trim, parameterName=code_block_21)
add_5 = ʳʰʸᵗʰᵐ_elements_7 + code_block_20
string_from_object_7 = FromObject(object=add_5)
toNumber_5 = String.ToNumber(string=string_from_object_7)
code_block_22 = CodeBlock { "Sill Thickness"; }
ʳʰʸᵗʰᵐ_elements_8 = Rhythm.Revit.Elements.Elements.GetParameterValueByNameTypeOrInstance(element=window_trim, parameterName=code_block_22)
add_6 = ʳʰʸᵗʰᵐ_elements_8 + code_block_20
string_from_object_8 = FromObject(object=add_6)
toNumber_6 = String.ToNumber(string=string_from_object_8)
code_block_23 = CodeBlock { "Bottom Sill Offset"; }
ʳʰʸᵗʰᵐ_elements_9 = Rhythm.Revit.Elements.Elements.GetParameterValueByNameTypeOrInstance(element=window_trim, parameterName=code_block_23)
add_7 = ʳʰʸᵗʰᵐ_elements_9 + code_block_20
string_from_object_9 = FromObject(object=add_7)
toNumber_7 = String.ToNumber(string=string_from_object_9)
code_block_24 = CodeBlock { "Bottom Sill Width"; }
ʳʰʸᵗʰᵐ_elements_10 = Rhythm.Revit.Elements.Elements.GetParameterValueByNameTypeOrInstance(element=window_trim, parameterName=code_block_24)
add_8 = ʳʰʸᵗʰᵐ_elements_10 + code_block_20
string_from_object_10 = FromObject(object=add_8)
toNumber_8 = String.ToNumber(string=string_from_object_10)
code_block_25 = CodeBlock { "Sill Height"; }
ʳʰʸᵗʰᵐ_elements_11 = Rhythm.Revit.Elements.Elements.GetParameterValueByNameTypeOrInstance(element=window_trim, parameterName=code_block_25)
add_9 = ʳʰʸᵗʰᵐ_elements_11 + code_block_20
string_from_object_11 = FromObject(object=add_9)
toNumber_9 = String.ToNumber(string=string_from_object_11)
list_create_2 = List.Create(item0=toNumber_4, item1=toNumber_5, item2=toNumber_6, item3=toNumber_7, item4=toNumber_8, item5=toNumber_9)
sum_2 = Math.Sum(values=list_create_2)

# group: If Condetion
elementType_3 = Revit.LinkElement.ElementType(linkElement=s_w_d_single_windows_doors)
string_from_object_12 = FromObject(object=elementType_3)
code_block_26 = CodeBlock { "Door"; }
contains_3 = String.Contains(string=string_from_object_12, searchFor=code_block_26)
countTrue_3 = List.CountTrue(list=contains_3)
code_block_27 = CodeBlock { 1; }
code_block_28 = CodeBlock(x=countTrue_3, y=code_block_27) { x>=y; }
if_3 = RefactoredIf(test=code_block_28, true=sum, false=sum_2)

# group: Point Creator
getLocation = Element.GetLocation(element=s_w_d_single_windows_doors)
X = Point.X(point=getLocation)
Y = Point.Y(point=getLocation)
Z = Point.Z(point=getLocation)
sub = Z - if_3
byCoordinates = Point.ByCoordinates(x=X, y=Y, z=sub)

# group (continued): Get Trim
byHostAndPoint = FamilyInstance.ByHostAndPoint(familyType=type, host=element_host, point=byCoordinates)

# group: Family Data
parameters = Element.Parameters(element=window_trim)
watch_3 = Watch(parameters)
type_2 = archilab.Revit.Elements.Elements.Type(element=window_trim)
parameters_2 = Element.Parameters(element=type_2)
watch_4 = Watch(parameters_2)

# group: Match Properties
string_from_object_13 = FromObject(object=watch_3)
string = StringInput(":")
lastIndexOf = String.LastIndexOf(string=string_from_object_13, searchFor=string)
length = String.Length(string=string_from_object_13)
sub_2 = length - lastIndexOf
substring = String.Substring(string=string_from_object_13, startIndex=lastIndexOf, length=sub_2)
string_2 = StringInput("")
replace = String.Replace(string=string_from_object_13, searchFor=substring, replaceWith=string_2)
trimTrailingWhitespace = String.TrimTrailingWhitespace(string=replace)
code_block_29 = CodeBlock()
# ---------- code_block_29.designscript (37 lines) ----------
"Area";
"Category";
"Comments";
"Design Option";
"Documentation : https";
"Elevation from Level";
"Export to IFC";
"Export to IFC As";
"Family";
"Family and Type : WTS_Trim_Interior_Window_Flat_Header";
"Family Name";
"Host Id";
"hsbcad Assembly Name";
"hsbcad Beam Code";
"hsbcad Beam Id";
"hsbcad Beam Type";
"hsbcad Element Type";
"hsbcad Item Container Name";
"hsbcad Module";
"hsbcad Panel Number";
"hsbcad Posnum";
"hsbcad Weight";
"IFC Predefined Type";
"IfcGUID";
"Image";
"Level";
"Mark";
"Phase Created";
"Phase Demolished";
"Type";
"Type Id";
"Type Name";
"Volume";
"Window Height";
"Window Width";
"Door Height";
"Door Width";
# ----------------------------------------
list_create_3 = List.Create(item0=code_block_29.out0, item1=code_block_29.out1, item2=code_block_29.out2, item3=code_block_29.out3, item4=code_block_29.out4, item5=code_block_29.out5, item6=code_block_29.out6, item7=code_block_29.out7, item8=code_block_29.out8, item9=code_block_29.out9, item10=code_block_29.out10, item11=code_block_29.out11, item12=code_block_29.out12, item13=code_block_29.out13, item14=code_block_29.out14, item15=code_block_29.out15, item16=code_block_29.out16, item17=code_block_29.out17, item18=code_block_29.out18, item19=code_block_29.out19, item20=code_block_29.out20, item21=code_block_29.out21, item22=code_block_29.out22, item23=code_block_29.out23, item24=code_block_29.out24, item25=code_block_29.out25, item26=code_block_29.out26, item27=code_block_29.out27, item28=code_block_29.out28, item29=code_block_29.out29, item30=code_block_29.out30, item31=code_block_29.out31, item32=code_block_29.out32, item33=code_block_29.out33, item34=code_block_29.out34, item35=code_block_29.out35, item36=code_block_29.out36)
contains_4 = String.Contains(string=trimTrailingWhitespace, searchFor=list_create_3, lacing=CrossProduct)
anyTrue = Custom[Booleans.AnyTrue](seq=contains_4)  # package Clockwork for Dynamo 2.x; Returns true if any item in a list of booleans is true. ATTENTION: This node will be deprecated in 2024. As of Revit 2022, please switch to the OOTB node AnyTrue.
filterByBoolMask = List.FilterByBoolMask(list=trimTrailingWhitespace, mask=anyTrue)
watch_5 = Watch(filterByBoolMask.out)

# group: Match Type
firstItem = List.FirstItem(list=byHostAndPoint)
code_block_30 = CodeBlock { 1; }
chop = List.Chop(list=watch_5, lengths=code_block_30, lacing=CrossProduct)
ʳʰʸᵗʰᵐ_elements_12 = Rhythm.Revit.Elements.Elements.GetParameterValueByNameTypeOrInstance(element=window_trim, parameterName=watch_5, lacing=Longest)
code_block_31 = CodeBlock { 1; }
chop_2 = List.Chop(list=ʳʰʸᵗʰᵐ_elements_12, lengths=code_block_31, lacing=CrossProduct)
ʳʰʸᵗʰᵐ_elements_13 = Rhythm.Revit.Elements.Elements.SetParameterByNameTypeOrInstance(element=firstItem, parameterName=chop, value=chop_2, lacing=Longest)
watch_6 = Watch(ʳʰʸᵗʰᵐ_elements_12)

# group: MATCH
code_block_32 = CodeBlock { 3; }
getItemAtIndex = List.GetItemAtIndex(list=byHostAndPoint, index=code_block_32)
code_block_33 = CodeBlock { 4; }
getItemAtIndex_2 = List.GetItemAtIndex(list=byHostAndPoint, index=code_block_33)
code_block_34 = CodeBlock { 5; }
getItemAtIndex_3 = List.GetItemAtIndex(list=byHostAndPoint, index=code_block_34)
code_block_35 = CodeBlock { 6; }
getItemAtIndex_4 = List.GetItemAtIndex(list=byHostAndPoint, index=code_block_35)
code_block_36 = CodeBlock { 7; }
getItemAtIndex_5 = List.GetItemAtIndex(list=byHostAndPoint, index=code_block_36)
code_block_37 = CodeBlock { 8; }
getItemAtIndex_6 = List.GetItemAtIndex(list=byHostAndPoint, index=code_block_37)
code_block_38 = CodeBlock { 9; }
getItemAtIndex_7 = List.GetItemAtIndex(list=byHostAndPoint, index=code_block_38)
code_block_39 = CodeBlock { 10; }
getItemAtIndex_8 = List.GetItemAtIndex(list=byHostAndPoint, index=code_block_39)
code_block_40 = CodeBlock { 11; }
getItemAtIndex_9 = List.GetItemAtIndex(list=byHostAndPoint, index=code_block_40)
code_block_41 = CodeBlock { 1; }
getItemAtIndex_10 = List.GetItemAtIndex(list=byHostAndPoint, index=code_block_41)
code_block_42 = CodeBlock { 2; }
getItemAtIndex_11 = List.GetItemAtIndex(list=byHostAndPoint, index=code_block_42)
code_block_43 = CodeBlock { 12; }
getItemAtIndex_12 = List.GetItemAtIndex(list=byHostAndPoint, index=code_block_43)
code_block_44 = CodeBlock { 13; }
getItemAtIndex_13 = List.GetItemAtIndex(list=byHostAndPoint, index=code_block_44)
code_block_45 = CodeBlock { 14; }
getItemAtIndex_14 = List.GetItemAtIndex(list=byHostAndPoint, index=code_block_45)
code_block_46 = CodeBlock { 15; }
getItemAtIndex_15 = List.GetItemAtIndex(list=byHostAndPoint, index=code_block_46)
code_block_47 = CodeBlock { 16; }
getItemAtIndex_16 = List.GetItemAtIndex(list=byHostAndPoint, index=code_block_47)
code_block_48 = CodeBlock { 17; }
getItemAtIndex_17 = List.GetItemAtIndex(list=byHostAndPoint, index=code_block_48)
code_block_49 = CodeBlock { 18; }
getItemAtIndex_18 = List.GetItemAtIndex(list=byHostAndPoint, index=code_block_49)
code_block_50 = CodeBlock { 19; }
getItemAtIndex_19 = List.GetItemAtIndex(list=byHostAndPoint, index=code_block_50)
code_block_51 = CodeBlock { 20; }
getItemAtIndex_20 = List.GetItemAtIndex(list=byHostAndPoint, index=code_block_51)

# group: PROPERTIES
ʳʰʸᵗʰᵐ_elements_14 = Rhythm.Revit.Elements.Elements.SetParameterByNameTypeOrInstance(element=getItemAtIndex, parameterName=chop, value=chop_2, lacing=Longest)
ʳʰʸᵗʰᵐ_elements_15 = Rhythm.Revit.Elements.Elements.SetParameterByNameTypeOrInstance(element=getItemAtIndex_2, parameterName=chop, value=chop_2, lacing=Longest)
ʳʰʸᵗʰᵐ_elements_16 = Rhythm.Revit.Elements.Elements.SetParameterByNameTypeOrInstance(element=getItemAtIndex_3, parameterName=chop, value=chop_2, lacing=Longest)
ʳʰʸᵗʰᵐ_elements_17 = Rhythm.Revit.Elements.Elements.SetParameterByNameTypeOrInstance(element=getItemAtIndex_4, parameterName=chop, value=chop_2, lacing=Longest)
ʳʰʸᵗʰᵐ_elements_18 = Rhythm.Revit.Elements.Elements.SetParameterByNameTypeOrInstance(element=getItemAtIndex_5, parameterName=chop, value=chop_2, lacing=Longest)
ʳʰʸᵗʰᵐ_elements_19 = Rhythm.Revit.Elements.Elements.SetParameterByNameTypeOrInstance(element=getItemAtIndex_6, parameterName=chop, value=chop_2, lacing=Longest)
ʳʰʸᵗʰᵐ_elements_20 = Rhythm.Revit.Elements.Elements.SetParameterByNameTypeOrInstance(element=getItemAtIndex_7, parameterName=chop, value=chop_2, lacing=Longest)
ʳʰʸᵗʰᵐ_elements_21 = Rhythm.Revit.Elements.Elements.SetParameterByNameTypeOrInstance(element=getItemAtIndex_8, parameterName=chop, value=chop_2, lacing=Longest)
ʳʰʸᵗʰᵐ_elements_22 = Rhythm.Revit.Elements.Elements.SetParameterByNameTypeOrInstance(element=getItemAtIndex_9, parameterName=chop, value=chop_2, lacing=Longest)
ʳʰʸᵗʰᵐ_elements_23 = Rhythm.Revit.Elements.Elements.SetParameterByNameTypeOrInstance(element=getItemAtIndex_10, parameterName=chop, value=chop_2, lacing=Longest)
ʳʰʸᵗʰᵐ_elements_24 = Rhythm.Revit.Elements.Elements.SetParameterByNameTypeOrInstance(element=getItemAtIndex_11, parameterName=chop, value=chop_2, lacing=Longest)
ʳʰʸᵗʰᵐ_elements_25 = Rhythm.Revit.Elements.Elements.SetParameterByNameTypeOrInstance(element=getItemAtIndex_12, parameterName=chop, value=chop_2, lacing=Longest)
ʳʰʸᵗʰᵐ_elements_26 = Rhythm.Revit.Elements.Elements.SetParameterByNameTypeOrInstance(element=getItemAtIndex_13, parameterName=chop, value=chop_2, lacing=Longest)
ʳʰʸᵗʰᵐ_elements_27 = Rhythm.Revit.Elements.Elements.SetParameterByNameTypeOrInstance(element=getItemAtIndex_14, parameterName=chop, value=chop_2, lacing=Longest)
ʳʰʸᵗʰᵐ_elements_28 = Rhythm.Revit.Elements.Elements.SetParameterByNameTypeOrInstance(element=getItemAtIndex_15, parameterName=chop, value=chop_2, lacing=Longest)
ʳʰʸᵗʰᵐ_elements_29 = Rhythm.Revit.Elements.Elements.SetParameterByNameTypeOrInstance(element=getItemAtIndex_16, parameterName=chop, value=chop_2, lacing=Longest)
ʳʰʸᵗʰᵐ_elements_30 = Rhythm.Revit.Elements.Elements.SetParameterByNameTypeOrInstance(element=getItemAtIndex_17, parameterName=chop, value=chop_2, lacing=Longest)
ʳʰʸᵗʰᵐ_elements_31 = Rhythm.Revit.Elements.Elements.SetParameterByNameTypeOrInstance(element=getItemAtIndex_18, parameterName=chop, value=chop_2, lacing=Longest)
ʳʰʸᵗʰᵐ_elements_32 = Rhythm.Revit.Elements.Elements.SetParameterByNameTypeOrInstance(element=getItemAtIndex_19, parameterName=chop, value=chop_2, lacing=Longest)
ʳʰʸᵗʰᵐ_elements_33 = Rhythm.Revit.Elements.Elements.SetParameterByNameTypeOrInstance(element=getItemAtIndex_20, parameterName=chop, value=chop_2, lacing=Longest)

# group: Trims Data
code_block_52 = CodeBlock { "Door Width"; }
code_block_53 = CodeBlock { "Window Width"; }
code_block_54 = CodeBlock { "Door Height"; }
code_block_55 = CodeBlock { "Window Height"; }

# group: If Condetion
elementType_4 = Revit.LinkElement.ElementType(linkElement=s_w_d_single_windows_doors)
string_from_object_14 = FromObject(object=elementType_4)
code_block_56 = CodeBlock { "Door"; }
contains_5 = String.Contains(string=string_from_object_14, searchFor=code_block_56)
countTrue_4 = List.CountTrue(list=contains_5)
code_block_57 = CodeBlock { 1; }
code_block_58 = CodeBlock(x=countTrue_4, y=code_block_57) { x>=y; }
if_4 = RefactoredIf(test=code_block_58, true=code_block_52, false=code_block_53)

# group (continued): Trims Data
ʳʰʸᵗʰᵐ_elements_34 = Rhythm.Revit.Elements.Elements.SetParameterByNameTypeOrInstance(element=byHostAndPoint, parameterName=if_4, value=ʳʰʸᵗʰᵐ_elements)

# group: If Condetion
elementType_5 = Revit.LinkElement.ElementType(linkElement=s_w_d_single_windows_doors)
string_from_object_15 = FromObject(object=elementType_5)
code_block_59 = CodeBlock { "Door"; }
contains_6 = String.Contains(string=string_from_object_15, searchFor=code_block_59)
countTrue_5 = List.CountTrue(list=contains_6)
code_block_60 = CodeBlock { 1; }
code_block_61 = CodeBlock(x=countTrue_5, y=code_block_60) { x>=y; }
if_5 = RefactoredIf(test=code_block_61, true=code_block_54, false=code_block_55)

# group (continued): Trims Data
ʳʰʸᵗʰᵐ_elements_35 = Rhythm.Revit.Elements.Elements.SetParameterByNameTypeOrInstance(element=byHostAndPoint, parameterName=if_5, value=ʳʰʸᵗʰᵐ_elements_2)
