# Dynamo graph Auto Trims  m v 1.0 .dyn "Auto Trims m v 1.0" (Dynamo 2.16.2.5624)
# author: Yousef Altear
# packages: Rhythm 2023.9.1, archi-lab.net 2024.217.1024, Genius Loci 2023.7.13, GenerativeDesign.Revit 3.0.16.0, Clockwork for Dynamo 2.x 2.6.0

# group: Auto Window Trim
# note: Ⓒ Copyright of Script to Paragons Egypt Team

# group: Get Window
m_w_multiple_window = DSModelElementMutlipleSelection()  # 1 picked in the model; graph input

# group: Get Trim
window_trim = DSModelElementSelection()  # 1 picked in the model; graph input
type = archilab.Revit.Elements.Elements.Type(element=window_trim)
element_host = Custom[Element Host](element=m_w_multiple_window)  # package Genius Loci; Gets the host of the element. Unlike the OOTB node FamilyInstance.GetHost, it also works for elements hosted by a linked document, wall sweeps, foundations, railings and builing pads. Based on a Clockwork's node
firstItem = List.FirstItem(list=element_host)
parameters = Element.Parameters(element=window_trim)
watch = Watch(parameters)
parameters_2 = Element.Parameters(element=type)
watch_2 = Watch(parameters_2)
number = DoubleInput(11)
getItemAtIndex = List.GetItemAtIndex(list=watch_2, index=number)
name = Family.Name(family=window_trim)

# group: Sortation
getLocation = Element.GetLocation(element=m_w_multiple_window)
Z = Point.Z(point=getLocation)
code_block = CodeBlock { 2; }
round = Math.Round(number=Z, digits=code_block)
sortIndexByValue = List.SortIndexByValue(list=round)
sortListByAnother = archilab.Lists.Lists.SortListByAnother(list=m_w_multiple_window, sortBy=sortIndexByValue)
getLocation_2 = Element.GetLocation(element=sortListByAnother.list)
Z_2 = Point.Z(point=getLocation_2)
firstItem_2 = List.FirstItem(list=Z_2)
eq = Z_2 == firstItem_2
filterByBoolMask = List.FilterByBoolMask(list=sortListByAnother.list, mask=eq)
getLocation_3 = Element.GetLocation(element=filterByBoolMask.in)
Y = Point.Y(point=getLocation_3)
code_block_2 = CodeBlock { 2; }
round_2 = Math.Round(number=Y, digits=code_block_2)
sortIndexByValue_2 = List.SortIndexByValue(list=round_2)
sortListByAnother_2 = archilab.Lists.Lists.SortListByAnother(list=filterByBoolMask.in, sortBy=sortIndexByValue_2)
getLocation_4 = Element.GetLocation(element=sortListByAnother_2.list)
X = Point.X(point=getLocation_4)
code_block_3 = CodeBlock { 2; }
round_3 = Math.Round(number=X, digits=code_block_3)
sortIndexByValue_3 = List.SortIndexByValue(list=round_3)
sortListByAnother_3 = archilab.Lists.Lists.SortListByAnother(list=sortListByAnother_2.list, sortBy=sortIndexByValue_3)
getLocation_5 = Element.GetLocation(element=filterByBoolMask.out)
X_2 = Point.X(point=getLocation_5)
sortListByAnother_4 = archilab.Lists.Lists.SortListByAnother(list=filterByBoolMask.out, sortBy=X_2)
getLocation_6 = Element.GetLocation(element=sortListByAnother_4.list)
Y_2 = Point.Y(point=getLocation_6)
sortListByAnother_5 = archilab.Lists.Lists.SortListByAnother(list=sortListByAnother_4.list, sortBy=Y_2)
count = List.Count(list=sortListByAnother_5.list)
count_2 = List.Count(list=sortListByAnother_3.list)

# group: Get Width
firstItem_3 = List.FirstItem(list=sortListByAnother_3.list)
getLocation_7 = Element.GetLocation(element=firstItem_3)
lastItem = List.LastItem(list=sortListByAnother_3.list)
getLocation_8 = Element.GetLocation(element=lastItem)
byStartPointEndPoint = Line.ByStartPointEndPoint(startPoint=getLocation_7, endPoint=getLocation_8)
length = Curve.Length(curve=byStartPointEndPoint)
code_block_4 = CodeBlock { 0; }
list_create = List.Create(item0=length, item1=code_block_4)
replaceNull = archilab.Lists.Lists.ReplaceNull(list=list_create, replacement=code_block_4)
sum = Math.Sum(values=replaceNull)
list_create_2 = List.Create(item0=firstItem_3, item1=lastItem)
code_block_5 = CodeBlock { "Width"; }
ʳʰʸᵗʰᵐ_elements = Rhythm.Revit.Elements.Elements.GetParameterValueByNameTypeOrInstance(element=list_create_2, parameterName=code_block_5)
code_block_6 = CodeBlock { 2; }
div = ʳʰʸᵗʰᵐ_elements / code_block_6
sum_2 = Math.Sum(values=div)
add = sum + sum_2

# group: Point Creator
code_block_7 = CodeBlock { 2; }
pointsAtEqualChordLength = Curve.PointsAtEqualChordLength(curve=byStartPointEndPoint, divisions=code_block_7)
getLocation_9 = Element.GetLocation(element=firstItem_3)
X_3 = Point.X(point=getLocation_9)
code_block_8 = CodeBlock { 0; }
formula = Formula("x=y", y=code_block_8)  # unwired: x
Y_3 = Point.Y(point=getLocation_9)
Z_3 = Point.Z(point=getLocation_9)
code_block_9 = CodeBlock { "Lower Horizontal Trim Width"; }
ʳʰʸᵗʰᵐ_elements_2 = Rhythm.Revit.Elements.Elements.GetParameterValueByNameTypeOrInstance(element=window_trim, parameterName=code_block_9)
code_block_10 = CodeBlock { "Sill Bottom Height"; }
ʳʰʸᵗʰᵐ_elements_3 = Rhythm.Revit.Elements.Elements.GetParameterValueByNameTypeOrInstance(element=window_trim, parameterName=code_block_10)
code_block_11 = CodeBlock { "Sill Thickness"; }
ʳʰʸᵗʰᵐ_elements_4 = Rhythm.Revit.Elements.Elements.GetParameterValueByNameTypeOrInstance(element=window_trim, parameterName=code_block_11)
code_block_12 = CodeBlock { "Bottom Sill Offset"; }
ʳʰʸᵗʰᵐ_elements_5 = Rhythm.Revit.Elements.Elements.GetParameterValueByNameTypeOrInstance(element=window_trim, parameterName=code_block_12)
code_block_13 = CodeBlock { "Bottom Sill Width"; }
ʳʰʸᵗʰᵐ_elements_6 = Rhythm.Revit.Elements.Elements.GetParameterValueByNameTypeOrInstance(element=window_trim, parameterName=code_block_13)
code_block_14 = CodeBlock { "Trim Width"; }
ʳʰʸᵗʰᵐ_elements_7 = Rhythm.Revit.Elements.Elements.GetParameterValueByNameTypeOrInstance(element=window_trim, parameterName=code_block_14)
list_create_3 = List.Create(item0=ʳʰʸᵗʰᵐ_elements_2, item1=ʳʰʸᵗʰᵐ_elements_3, item2=ʳʰʸᵗʰᵐ_elements_4, item3=ʳʰʸᵗʰᵐ_elements_5, item4=ʳʰʸᵗʰᵐ_elements_6, item5=ʳʰʸᵗʰᵐ_elements_7)
string_from_object = FromObject(object=list_create_3)
string = StringInput("")
eq_2 = string_from_object == string
filterByBoolMask_2 = List.FilterByBoolMask(list=list_create_3, mask=eq_2)
sum_3 = Math.Sum(values=filterByBoolMask_2.out)

# group: Chack point
X_4 = Point.X(point=pointsAtEqualChordLength)
list_create_4 = List.Create(item0=X_4)
flatten = List.Flatten(list=list_create_4)
code_block_15 = CodeBlock { 0; }
replaceNull_2 = archilab.Lists.Lists.ReplaceNull(list=flatten, replacement=code_block_15)
sum_4 = Math.Sum(values=replaceNull_2)
Y_4 = Point.Y(point=pointsAtEqualChordLength)
list_create_5 = List.Create(item0=Y_4, item1=code_block_15)
flatten_2 = List.Flatten(list=list_create_5)
replaceNull_3 = archilab.Lists.Lists.ReplaceNull(list=flatten_2, replacement=code_block_15)
sum_5 = Math.Sum(values=replaceNull_3)
Z_4 = Point.Z(point=pointsAtEqualChordLength)
list_create_6 = List.Create(item0=Z_4, item1=code_block_15)
flatten_3 = List.Flatten(list=list_create_6)
replaceNull_4 = archilab.Lists.Lists.ReplaceNull(list=flatten_3, replacement=code_block_15)
sum_6 = Math.Sum(values=replaceNull_4)

# group (continued): Point Creator
replaceByCondition = Replace(item=sum_4, replaceWith=X_3, condition=formula)
replaceByCondition_2 = Replace(item=sum_5, replaceWith=Y_3, condition=formula)
replaceByCondition_3 = Replace(item=sum_6, replaceWith=Z_3, condition=formula)
sub = replaceByCondition_3 - sum_3
byCoordinates = Point.ByCoordinates(x=replaceByCondition, y=replaceByCondition_2, z=sub)

# group (continued): Get Trim
byHostAndPoint = FamilyInstance.ByHostAndPoint(familyType=type, host=firstItem, point=byCoordinates, lacing=Longest)

# group: Get height
firstItem_4 = List.FirstItem(list=sortListByAnother_5.list)
code_block_16 = CodeBlock { "Height"; }
ʳʰʸᵗʰᵐ_elements_8 = Rhythm.Revit.Elements.Elements.GetParameterValueByNameTypeOrInstance(element=firstItem_4, parameterName=code_block_16)
code_block_17 = CodeBlock { 0; }
list_create_7 = List.Create(item0=ʳʰʸᵗʰᵐ_elements_8, item1=code_block_17)
replaceNull_5 = archilab.Lists.Lists.ReplaceNull(list=list_create_7, replacement=code_block_17)
sum_7 = Math.Sum(values=replaceNull_5)
ʳʰʸᵗʰᵐ_elements_9 = Rhythm.Revit.Elements.Elements.GetParameterValueByNameTypeOrInstance(element=firstItem_3, parameterName=code_block_16)
getLocation_10 = Element.GetLocation(element=firstItem_4)
getLocation_11 = Element.GetLocation(element=firstItem_3)
byStartPointEndPoint_2 = Line.ByStartPointEndPoint(startPoint=getLocation_10, endPoint=getLocation_11)
length_2 = Curve.Length(curve=byStartPointEndPoint_2)
list_create_8 = List.Create(item0=length_2, item1=code_block_17)
replaceNull_6 = archilab.Lists.Lists.ReplaceNull(list=list_create_8, replacement=code_block_17)
sum_8 = Math.Sum(values=replaceNull_6)
sub_2 = sum_8 - ʳʰʸᵗʰᵐ_elements_9
list_create_9 = List.Create(item0=sub_2)
code_block_18 = CodeBlock { 0; }
code_block_19 = CodeBlock { 2; }
mul = ʳʰʸᵗʰᵐ_elements_9 * code_block_19
sub_3 = ʳʰʸᵗʰᵐ_elements_9 - mul
formula_2 = Formula("x=y", y=sub_3)  # unwired: x
replaceByCondition_4 = Replace(item=list_create_9, replaceWith=code_block_18, condition=formula_2)
code_block_20 = CodeBlock(a=sum_7, b=ʳʰʸᵗʰᵐ_elements_9, c=replaceByCondition_4) { a+b+c; }

# group: Trims Data
code_block_21 = CodeBlock { "Window Height"; }
ʳʰʸᵗʰᵐ_elements_10 = Rhythm.Revit.Elements.Elements.SetParameterByNameTypeOrInstance(element=byHostAndPoint, parameterName=code_block_21, value=code_block_20)
code_block_22 = CodeBlock { "Window Width"; }
ʳʰʸᵗʰᵐ_elements_11 = Rhythm.Revit.Elements.Elements.SetParameterByNameTypeOrInstance(element=byHostAndPoint, parameterName=code_block_22, value=add)

# group: Family Data
parameters_3 = Element.Parameters(element=m_w_multiple_window)
watch_3 = Watch(parameters_3)
type_2 = archilab.Revit.Elements.Elements.Type(element=m_w_multiple_window)
parameters_4 = Element.Parameters(element=type_2)
watch_4 = Watch(parameters_4)

# group: Vertical trim
string_from_object_2 = FromObject(object=m_w_multiple_window)
code_block_23 = CodeBlock { "Main"; }
eq_3 = string_from_object_2 == code_block_23
filterByBoolMask_3 = List.FilterByBoolMask(list=m_w_multiple_window, mask=eq_3)
code_block_24 = CodeBlock { "Secondary"; }
eq_4 = string_from_object_2 == code_block_24
filterByBoolMask_4 = List.FilterByBoolMask(list=m_w_multiple_window, mask=eq_4)
list_create_10 = List.Create(item0=filterByBoolMask_3.in, item1=filterByBoolMask_4.in)
flatten_4 = List.Flatten(list=list_create_10)

# group: Mulion Data
code_block_25 = CodeBlock { "Height"; }
ʳʰʸᵗʰᵐ_elements_12 = Rhythm.Revit.Elements.Elements.GetParameterValueByNameTypeOrInstance(element=flatten_4, parameterName=code_block_25)
watch_5 = Watch(ʳʰʸᵗʰᵐ_elements_12)
code_block_26 = CodeBlock { "Width"; }
ʳʰʸᵗʰᵐ_elements_13 = Rhythm.Revit.Elements.Elements.GetParameterValueByNameTypeOrInstance(element=flatten_4, parameterName=code_block_26)
watch_6 = Watch(ʳʰʸᵗʰᵐ_elements_13)

# group: Get Vertical Trim
string_2 = StringInput("WTS_Trim_Exterior_Window_Vertical")
byName = Family.ByName(name=string_2)
types = Family.Types(family=byName)
name_2 = Family.Name(family=types)
eq_5 = name_2 == name
filterByBoolMask_5 = List.FilterByBoolMask(list=types, mask=eq_5)
element_host_2 = Custom[Element Host](element=flatten_4)
getLocation_12 = Element.GetLocation(element=flatten_4)
byHostAndPoint_2 = FamilyInstance.ByHostAndPoint(familyType=filterByBoolMask_5.in, host=element_host_2, point=getLocation_12, lacing=Longest)

# group: Trims Data
code_block_27 = CodeBlock { "Window Height"; }
ʳʰʸᵗʰᵐ_elements_14 = Rhythm.Revit.Elements.Elements.SetParameterByNameTypeOrInstance(element=byHostAndPoint_2, parameterName=code_block_27, value=ʳʰʸᵗʰᵐ_elements_12)
code_block_28 = CodeBlock { "Trim Width"; }
ʳʰʸᵗʰᵐ_elements_15 = Rhythm.Revit.Elements.Elements.SetParameterByNameTypeOrInstance(element=byHostAndPoint_2, parameterName=code_block_28, value=ʳʰʸᵗʰᵐ_elements_13)

replaceItemAtIndex = Custom[List.ReplaceItemAtIndex+]()  # package Clockwork for Dynamo 2.x; Replaces the item at a given index of a list by another item. Unlike the OOTB node, it can replace items at multiple indeces.; unwired: seq, indices, replacement
