# Dynamo graph Auto Trims  m v 1.02 .dyn "Auto Trims m v 1.02" (Dynamo 2.16.2.5624)
# author: Yousef Altear
# packages: Rhythm 2023.9.1, archi-lab.net 2024.217.1024, Genius Loci 2023.7.13, GenerativeDesign.Revit 3.0.16.0, Clockwork for Dynamo 2.x 2.6.0

# group: Auto Window Trim
# note: Ⓒ Copyright of Script to Paragons Egypt Team

# group: Get Window
m_w_multiple_window = DSModelElementMutlipleSelection()  # 4 picked in the model; graph input

# group: Get Trim
window_trim = DSModelElementSelection()  # 1 picked in the model; graph input
type = archilab.Revit.Elements.Elements.Type(element=window_trim)
element_host = Custom[Element Host](element=m_w_multiple_window)  # package Genius Loci; Gets the host of the element. Unlike the OOTB node FamilyInstance.GetHost, it also works for elements hosted by a linked document, wall sweeps, foundations, railings and builing pads. Based on a Clockwork's node
firstItem = List.FirstItem(list=element_host)
parameters = Element.Parameters(element=window_trim)
watch = Watch(parameters)
parameters_2 = Element.Parameters(element=type)
watch_2 = Watch(parameters_2)
number = DoubleInput(11)
getItemAtIndex = List.GetItemAtIndex(list=watch_2, index=number)
name = Family.Name(family=window_trim)

# group: Sortation
getLocation = Element.GetLocation(element=m_w_multiple_window)
Z = Point.Z(point=getLocation)
code_block = CodeBlock { 2; }
round = Math.Round(number=Z, digits=code_block)
sortIndexByValue = List.SortIndexByValue(list=round)
sortListByAnother = archilab.Lists.Lists.SortListByAnother(list=m_w_multiple_window, sortBy=sortIndexByValue)
getLocation_2 = Element.GetLocation(element=sortListByAnother.list)
Z_2 = Point.Z(point=getLocation_2)
firstItem_2 = List.FirstItem(list=Z_2)
eq = Z_2 == firstItem_2
filterByBoolMask = List.FilterByBoolMask(list=sortListByAnother.list, mask=eq)
getLocation_3 = Element.GetLocation(element=filterByBoolMask.in)
Y = Point.Y(point=getLocation_3)
code_block_2 = CodeBlock { 2; }
round_2 = Math.Round(number=Y, digits=code_block_2)
sortIndexByValue_2 = List.SortIndexByValue(list=round_2)
sortListByAnother_2 = archilab.Lists.Lists.SortListByAnother(list=filterByBoolMask.in, sortBy=sortIndexByValue_2)
getLocation_4 = Element.GetLocation(element=sortListByAnother_2.list)
X = Point.X(point=getLocation_4)
code_block_3 = CodeBlock { 2; }
round_3 = Math.Round(number=X, digits=code_block_3)
sortIndexByValue_3 = List.SortIndexByValue(list=round_3)
sortListByAnother_3 = archilab.Lists.Lists.SortListByAnother(list=sortListByAnother_2.list, sortBy=sortIndexByValue_3)
getLocation_5 = Element.GetLocation(element=filterByBoolMask.out)
X_2 = Point.X(point=getLocation_5)
sortListByAnother_4 = archilab.Lists.Lists.SortListByAnother(list=filterByBoolMask.out, sortBy=X_2)
getLocation_6 = Element.GetLocation(element=sortListByAnother_4.list)
Y_2 = Point.Y(point=getLocation_6)
sortListByAnother_5 = archilab.Lists.Lists.SortListByAnother(list=sortListByAnother_4.list, sortBy=Y_2)
count = List.Count(list=sortListByAnother_5.list)
count_2 = List.Count(list=sortListByAnother_3.list)

# group: Get Width
firstItem_3 = List.FirstItem(list=sortListByAnother_3.list)
getLocation_7 = Element.GetLocation(element=firstItem_3)
lastItem = List.LastItem(list=sortListByAnother_3.list)
getLocation_8 = Element.GetLocation(element=lastItem)
code_block_4 = CodeBlock { 0; }
list_create = List.Create(item0=firstItem_3, item1=lastItem)
code_block_5 = CodeBlock { "Width"; }
ʳʰʸᵗʰᵐ_elements = Rhythm.Revit.Elements.Elements.GetParameterValueByNameTypeOrInstance(element=list_create, parameterName=code_block_5)
code_block_6 = CodeBlock { 2; }
div = ʳʰʸᵗʰᵐ_elements / code_block_6
sum = Math.Sum(values=div)

# group: Line
byStartPointEndPoint = Line.ByStartPointEndPoint(startPoint=getLocation_7, endPoint=getLocation_8)
getLocation_9 = Element.GetLocation(element=sortListByAnother_3.list, lacing=Longest)
splitByPoints = Curve.SplitByPoints(curve=byStartPointEndPoint, points=getLocation_9)
code_block_7 = CodeBlock { 2; }
pointsAtEqualChordLength = Curve.PointsAtEqualChordLength(curve=splitByPoints, divisions=code_block_7)
firstItem_4 = List.FirstItem(list=splitByPoints)
length = Curve.Length(curve=firstItem_4)
firstItem_5 = List.FirstItem(list=sortListByAnother_3.list)
code_block_8 = CodeBlock { "Width"; }
ʳʰʸᵗʰᵐ_elements_2 = Rhythm.Revit.Elements.Elements.GetParameterValueByNameTypeOrInstance(element=firstItem_5, parameterName=code_block_8)
sub = length - ʳʰʸᵗʰᵐ_elements_2

# group: Point Creator
code_block_9 = CodeBlock { 2; }
pointsAtEqualChordLength_2 = Curve.PointsAtEqualChordLength(curve=byStartPointEndPoint, divisions=code_block_9)
getLocation_10 = Element.GetLocation(element=firstItem_3)
X_3 = Point.X(point=getLocation_10)
code_block_10 = CodeBlock { 0; }
formula = Formula("x=y", y=code_block_10)  # unwired: x
Y_3 = Point.Y(point=getLocation_10)
Z_3 = Point.Z(point=getLocation_10)
code_block_11 = CodeBlock { "Lower Horizontal Trim Width"; }
ʳʰʸᵗʰᵐ_elements_3 = Rhythm.Revit.Elements.Elements.GetParameterValueByNameTypeOrInstance(element=window_trim, parameterName=code_block_11)
code_block_12 = CodeBlock { "Sill Bottom Height"; }
ʳʰʸᵗʰᵐ_elements_4 = Rhythm.Revit.Elements.Elements.GetParameterValueByNameTypeOrInstance(element=window_trim, parameterName=code_block_12)
code_block_13 = CodeBlock { "Sill Thickness"; }
ʳʰʸᵗʰᵐ_elements_5 = Rhythm.Revit.Elements.Elements.GetParameterValueByNameTypeOrInstance(element=window_trim, parameterName=code_block_13)
code_block_14 = CodeBlock { "Bottom Sill Offset"; }
ʳʰʸᵗʰᵐ_elements_6 = Rhythm.Revit.Elements.Elements.GetParameterValueByNameTypeOrInstance(element=window_trim, parameterName=code_block_14)
code_block_15 = CodeBlock { "Bottom Sill Width"; }
ʳʰʸᵗʰᵐ_elements_7 = Rhythm.Revit.Elements.Elements.GetParameterValueByNameTypeOrInstance(element=window_trim, parameterName=code_block_15)
code_block_16 = CodeBlock { "Trim Width"; }
ʳʰʸᵗʰᵐ_elements_8 = Rhythm.Revit.Elements.Elements.GetParameterValueByNameTypeOrInstance(element=window_trim, parameterName=code_block_16)
list_create_2 = List.Create(item0=ʳʰʸᵗʰᵐ_elements_3, item1=ʳʰʸᵗʰᵐ_elements_4, item2=ʳʰʸᵗʰᵐ_elements_5, item3=ʳʰʸᵗʰᵐ_elements_6, item4=ʳʰʸᵗʰᵐ_elements_7, item5=ʳʰʸᵗʰᵐ_elements_8)
string_from_object = FromObject(object=list_create_2)
string = StringInput("")
eq_2 = string_from_object == string
filterByBoolMask_2 = List.FilterByBoolMask(list=list_create_2, mask=eq_2)
sum_2 = Math.Sum(values=filterByBoolMask_2.out)

# group: Chack point
X_4 = Point.X(point=pointsAtEqualChordLength_2)
list_create_3 = List.Create(item0=X_4)
flatten = List.Flatten(list=list_create_3)
code_block_17 = CodeBlock { 0; }
replaceNull = archilab.Lists.Lists.ReplaceNull(list=flatten, replacement=code_block_17)
sum_3 = Math.Sum(values=replaceNull)
Y_4 = Point.Y(point=pointsAtEqualChordLength_2)
list_create_4 = List.Create(item0=Y_4, item1=code_block_17)
flatten_2 = List.Flatten(list=list_create_4)
replaceNull_2 = archilab.Lists.Lists.ReplaceNull(list=flatten_2, replacement=code_block_17)
sum_4 = Math.Sum(values=replaceNull_2)
Z_4 = Point.Z(point=pointsAtEqualChordLength_2)
list_create_5 = List.Create(item0=Z_4, item1=code_block_17)
flatten_3 = List.Flatten(list=list_create_5)
replaceNull_3 = archilab.Lists.Lists.ReplaceNull(list=flatten_3, replacement=code_block_17)
sum_5 = Math.Sum(values=replaceNull_3)

# group (continued): Point Creator
replaceByCondition = Replace(item=sum_3, replaceWith=X_3, condition=formula)
replaceByCondition_2 = Replace(item=sum_4, replaceWith=Y_3, condition=formula)
replaceByCondition_3 = Replace(item=sum_5, replaceWith=Z_3, condition=formula)
sub_2 = replaceByCondition_3 - sum_2
byCoordinates = Point.ByCoordinates(x=replaceByCondition, y=replaceByCondition_2, z=sub_2)

# group (continued): Get Trim
byHostAndPoint = FamilyInstance.ByHostAndPoint(familyType=type, host=firstItem, point=byCoordinates, lacing=Longest)

# group: Get height
firstItem_6 = List.FirstItem(list=sortListByAnother_5.list)
code_block_18 = CodeBlock { "Height"; }
ʳʰʸᵗʰᵐ_elements_9 = Rhythm.Revit.Elements.Elements.GetParameterValueByNameTypeOrInstance(element=firstItem_6, parameterName=code_block_18)
code_block_19 = CodeBlock { 0; }
list_create_6 = List.Create(item0=ʳʰʸᵗʰᵐ_elements_9, item1=code_block_19)
replaceNull_4 = archilab.Lists.Lists.ReplaceNull(list=list_create_6, replacement=code_block_19)
sum_6 = Math.Sum(values=replaceNull_4)
ʳʰʸᵗʰᵐ_elements_10 = Rhythm.Revit.Elements.Elements.GetParameterValueByNameTypeOrInstance(element=firstItem_3, parameterName=code_block_18)
getLocation_11 = Element.GetLocation(element=firstItem_6)
getLocation_12 = Element.GetLocation(element=firstItem_3)
byStartPointEndPoint_2 = Line.ByStartPointEndPoint(startPoint=getLocation_11, endPoint=getLocation_12)
length_2 = Curve.Length(curve=byStartPointEndPoint_2)
list_create_7 = List.Create(item0=length_2, item1=code_block_19)
replaceNull_5 = archilab.Lists.Lists.ReplaceNull(list=list_create_7, replacement=code_block_19)
sum_7 = Math.Sum(values=replaceNull_5)
sub_3 = sum_7 - ʳʰʸᵗʰᵐ_elements_10
list_create_8 = List.Create(item0=sub_3)
code_block_20 = CodeBlock { 0; }
code_block_21 = CodeBlock { 2; }
mul = ʳʰʸᵗʰᵐ_elements_10 * code_block_21
sub_4 = ʳʰʸᵗʰᵐ_elements_10 - mul
formula_2 = Formula("x=y", y=sub_4)  # unwired: x
replaceByCondition_4 = Replace(item=list_create_8, replaceWith=code_block_20, condition=formula_2)
code_block_22 = CodeBlock(a=sum_6, b=ʳʰʸᵗʰᵐ_elements_10, c=replaceByCondition_4) { a+b+c; }

# group (continued): Get Width
length_3 = Curve.Length(curve=byStartPointEndPoint)
list_create_9 = List.Create(item0=length_3, item1=code_block_4)
replaceNull_6 = archilab.Lists.Lists.ReplaceNull(list=list_create_9, replacement=code_block_4)
sum_8 = Math.Sum(values=replaceNull_6)
add = sum_8 + sum

# group: Trims Data
code_block_23 = CodeBlock { "Window Height"; }
ʳʰʸᵗʰᵐ_elements_11 = Rhythm.Revit.Elements.Elements.SetParameterByNameTypeOrInstance(element=byHostAndPoint, parameterName=code_block_23, value=code_block_22)
code_block_24 = CodeBlock { "Window Width"; }
ʳʰʸᵗʰᵐ_elements_12 = Rhythm.Revit.Elements.Elements.SetParameterByNameTypeOrInstance(element=byHostAndPoint, parameterName=code_block_24, value=add)

# group: Family Data
parameters_3 = Element.Parameters(element=m_w_multiple_window)
watch_3 = Watch(parameters_3)
type_2 = archilab.Revit.Elements.Elements.Type(element=m_w_multiple_window)
parameters_4 = Element.Parameters(element=type_2)
watch_4 = Watch(parameters_4)

# group: Vertical trim
string_from_object_2 = FromObject(object=m_w_multiple_window)
code_block_25 = CodeBlock { "Main"; }
eq_3 = string_from_object_2 == code_block_25
filterByBoolMask_3 = List.FilterByBoolMask(list=m_w_multiple_window, mask=eq_3)
code_block_26 = CodeBlock { "Secondary"; }
eq_4 = string_from_object_2 == code_block_26
filterByBoolMask_4 = List.FilterByBoolMask(list=m_w_multiple_window, mask=eq_4)
list_create_10 = List.Create(item0=filterByBoolMask_3.in, item1=filterByBoolMask_4.in)
flatten_4 = List.Flatten(list=list_create_10)

# group: Mulion Data
code_block_27 = CodeBlock { "Height"; }
ʳʰʸᵗʰᵐ_elements_13 = Rhythm.Revit.Elements.Elements.GetParameterValueByNameTypeOrInstance(element=flatten_4, parameterName=code_block_27)
watch_5 = Watch(ʳʰʸᵗʰᵐ_elements_13)
code_block_28 = CodeBlock { "Width"; }
ʳʰʸᵗʰᵐ_elements_14 = Rhythm.Revit.Elements.Elements.GetParameterValueByNameTypeOrInstance(element=flatten_4, parameterName=code_block_28)
watch_6 = Watch(ʳʰʸᵗʰᵐ_elements_14)

# group: Get Vertical Trim
string_2 = StringInput("WTS_Trim_Exterior_Window_Vertical")
byName = Family.ByName(name=string_2)
types = Family.Types(family=byName)
name_2 = Family.Name(family=types)
eq_5 = name_2 == name
filterByBoolMask_5 = List.FilterByBoolMask(list=types, mask=eq_5)
element_host_2 = Custom[Element Host](element=sortListByAnother_3.list)
byHostAndPoint_2 = FamilyInstance.ByHostAndPoint(familyType=filterByBoolMask_5.in, host=element_host_2, point=pointsAtEqualChordLength, lacing=Longest)
flatten_5 = List.Flatten(list=byHostAndPoint_2)

# group: Trims Data
code_block_29 = CodeBlock { "Window Height"; }
ʳʰʸᵗʰᵐ_elements_15 = Rhythm.Revit.Elements.Elements.SetParameterByNameTypeOrInstance(element=flatten_5, parameterName=code_block_29, value=code_block_22, lacing=Longest)
code_block_30 = CodeBlock { "Trim Width"; }
ʳʰʸᵗʰᵐ_elements_16 = Rhythm.Revit.Elements.Elements.SetParameterByNameTypeOrInstance(element=flatten_5, parameterName=code_block_30, value=sub)

# group: Family Data
type_3 = archilab.Revit.Elements.Elements.Type(element=window_trim)
parameters_5 = Element.Parameters(element=type_3)
watch_7 = Watch(parameters_5)
parameters_6 = Element.Parameters(element=window_trim)
watch_8 = Watch(parameters_6)

# group: Match Properties
string_from_object_3 = FromObject(object=watch_8)
string_3 = StringInput(":")
lastIndexOf = String.LastIndexOf(string=string_from_object_3, searchFor=string_3)
length_4 = String.Length(string=string_from_object_3)
sub_5 = length_4 - lastIndexOf
substring = String.Substring(string=string_from_object_3, startIndex=lastIndexOf, length=sub_5)
string_4 = StringInput("")
replace = String.Replace(string=string_from_object_3, searchFor=substring, replaceWith=string_4)
trimTrailingWhitespace = String.TrimTrailingWhitespace(string=replace)
code_block_31 = CodeBlock()
# ---------- code_block_31.designscript (35 lines) ----------
"Area";
"Category";
"Comments";
"Design Option";
"Documentation : https";
"Elevation from Level";
"Export to IFC";
"Export to IFC As";
"Family";
"Family and Type : WTS_Trim_Interior_Window_Flat_Header";
"Family Name";
"Host Id";
"hsbcad Assembly Name";
"hsbcad Beam Code";
"hsbcad Beam Id";
"hsbcad Beam Type";
"hsbcad Element Type";
"hsbcad Item Container Name";
"hsbcad Module";
"hsbcad Panel Number";
"hsbcad Posnum";
"hsbcad Weight";
"IFC Predefined Type";
"IfcGUID";
"Image";
"Level";
"Mark";
"Phase Created";
"Phase Demolished";
"Type";
"Type Id";
"Type Name";
"Volume";
"Window Height";
"Window Width";
# ----------------------------------------
list_create_11 = List.Create(item0=code_block_31.out0, item1=code_block_31.out1, item2=code_block_31.out2, item3=code_block_31.out3, item4=code_block_31.out4, item5=code_block_31.out5, item6=code_block_31.out6, item7=code_block_31.out7, item8=code_block_31.out8, item9=code_block_31.out9, item10=code_block_31.out10, item11=code_block_31.out11, item12=code_block_31.out12, item13=code_block_31.out13, item14=code_block_31.out14, item15=code_block_31.out15, item16=code_block_31.out16, item17=code_block_31.out17, item18=code_block_31.out18, item19=code_block_31.out19, item20=code_block_31.out20, item21=code_block_31.out21, item22=code_block_31.out22, item23=code_block_31.out23, item24=code_block_31.out24, item25=code_block_31.out25, item26=code_block_31.out26, item27=code_block_31.out27, item28=code_block_31.out28, item29=code_block_31.out29, item30=code_block_31.out30, item31=code_block_31.out31, item32=code_block_31.out32, item33=code_block_31.out33, item34=code_block_31.out34)
contains = String.Contains(string=trimTrailingWhitespace, searchFor=list_create_11, lacing=CrossProduct)
anyTrue = Custom[Booleans.AnyTrue](seq=contains)  # package Clockwork for Dynamo 2.x; Returns true if any item in a list of booleans is true. ATTENTION: This node will be deprecated in 2024. As of Revit 2022, please switch to the OOTB node AnyTrue.
filterByBoolMask_6 = List.FilterByBoolMask(list=trimTrailingWhitespace, mask=anyTrue)
watch_9 = Watch(filterByBoolMask_6.out)

# group: Match Type
ʳʰʸᵗʰᵐ_elements_17 = Rhythm.Revit.Elements.Elements.GetParameterValueByNameTypeOrInstance(element=window_trim, parameterName=watch_9)
watch_10 = Watch(ʳʰʸᵗʰᵐ_elements_17)
ʳʰʸᵗʰᵐ_elements_18 = Rhythm.Revit.Elements.Elements.SetParameterByNameTypeOrInstance(element=byHostAndPoint, parameterName=watch_9, value=ʳʰʸᵗʰᵐ_elements_17)

exportToExcel = Data.ExportToExcel()  # unwired: filePath, sheetName, startRow, startColumn, data
string_5 = StringInput("C:\Users\alter\OneDrive\Desktop")
boolean = BoolSelector(true)
code_block_32 = CodeBlock { 0; }
code_block_33 = CodeBlock { "sheet 10"; }
window_trim_2 = DSModelElementSelection()  # 1 picked in the model; graph input
boolean_2 = BoolSelector(true)
setPinnedStatus = Element.SetPinnedStatus(element=byHostAndPoint, pinned=boolean_2)
