# Dynamo graph Auto Trims  m v 1.05 .dyn "Auto Trims m v 1.05" (Dynamo 2.16.2.5624)
# author: Yousef Altear
# packages: Rhythm 2023.9.1, archi-lab.net 2024.217.1024, Genius Loci 2023.7.13, GenerativeDesign.Revit 3.0.16.0, Clockwork for Dynamo 2.x 2.6.0

# group: Auto Window Trim
# note: Ⓒ Copyright of Script to Paragons Egypt Team

# group: Get Window
m_w_multiple_window = DSModelElementMutlipleSelection()  # 6 picked in the model; graph input

# group: Vertical trim
string_from_object = FromObject(object=m_w_multiple_window)
code_block = CodeBlock { "Secondary"; }
eq = string_from_object == code_block
filterByBoolMask = List.FilterByBoolMask(list=m_w_multiple_window, mask=eq)
code_block_2 = CodeBlock { "Main"; }
eq_2 = string_from_object == code_block_2
filterByBoolMask_2 = List.FilterByBoolMask(list=m_w_multiple_window, mask=eq_2)

# group: Get Trim
window_trim = DSModelElementSelection()  # 1 picked in the model; graph input
type = archilab.Revit.Elements.Elements.Type(element=window_trim)
element_host = Custom[Element Host](element=filterByBoolMask.out)  # package Genius Loci; Gets the host of the element. Unlike the OOTB node FamilyInstance.GetHost, it also works for elements hosted by a linked document, wall sweeps, foundations, railings and builing pads. Based on a Clockwork's node
firstItem = List.FirstItem(list=element_host)
parameters = Element.Parameters(element=window_trim)
watch = Watch(parameters)
parameters_2 = Element.Parameters(element=type)
watch_2 = Watch(parameters_2)
number = DoubleInput(11)
getItemAtIndex = List.GetItemAtIndex(list=watch_2, index=number)
name = Family.Name(family=window_trim)
boolean = BoolSelector(false)

# group: Sortation
getLocation = Element.GetLocation(element=filterByBoolMask.out)
Z = Point.Z(point=getLocation)
code_block_3 = CodeBlock { 2; }
round = Math.Round(number=Z, digits=code_block_3)
sortIndexByValue = List.SortIndexByValue(list=round)
sortListByAnother = archilab.Lists.Lists.SortListByAnother(list=filterByBoolMask.out, sortBy=sortIndexByValue)
getLocation_2 = Element.GetLocation(element=sortListByAnother.list)
Z_2 = Point.Z(point=getLocation_2)
firstItem_2 = List.FirstItem(list=Z_2)
eq_3 = Z_2 == firstItem_2
filterByBoolMask_3 = List.FilterByBoolMask(list=sortListByAnother.list, mask=eq_3)
getLocation_3 = Element.GetLocation(element=filterByBoolMask_3.in)
Y = Point.Y(point=getLocation_3)
code_block_4 = CodeBlock { 2; }
round_2 = Math.Round(number=Y, digits=code_block_4)
sortIndexByValue_2 = List.SortIndexByValue(list=round_2)
sortListByAnother_2 = archilab.Lists.Lists.SortListByAnother(list=filterByBoolMask_3.in, sortBy=sortIndexByValue_2)
getLocation_4 = Element.GetLocation(element=sortListByAnother_2.list)
X = Point.X(point=getLocation_4)
code_block_5 = CodeBlock { 2; }
round_3 = Math.Round(number=X, digits=code_block_5)
sortIndexByValue_3 = List.SortIndexByValue(list=round_3)
sortListByAnother_3 = archilab.Lists.Lists.SortListByAnother(list=sortListByAnother_2.list, sortBy=sortIndexByValue_3)
getLocation_5 = Element.GetLocation(element=filterByBoolMask_3.out)
Z_3 = Point.Z(point=getLocation_5)
firstItem_3 = List.FirstItem(list=Z_3)
eq_4 = firstItem_3 == Z_3
filterByBoolMask_4 = List.FilterByBoolMask(list=filterByBoolMask_3.out, mask=eq_4)
getLocation_6 = Element.GetLocation(element=filterByBoolMask_4.in)
X_2 = Point.X(point=getLocation_6)
sortListByAnother_4 = archilab.Lists.Lists.SortListByAnother(list=filterByBoolMask_4.in, sortBy=X_2)
getLocation_7 = Element.GetLocation(element=sortListByAnother_4.list)
Y_2 = Point.Y(point=getLocation_7)
sortListByAnother_5 = archilab.Lists.Lists.SortListByAnother(list=sortListByAnother_4.list, sortBy=Y_2)
getLocation_8 = Element.GetLocation(element=filterByBoolMask_4.out)
X_3 = Point.X(point=getLocation_8)
sortListByAnother_6 = archilab.Lists.Lists.SortListByAnother(list=filterByBoolMask_4.out, sortBy=X_3)
getLocation_9 = Element.GetLocation(element=sortListByAnother_6.list)
Y_3 = Point.Y(point=getLocation_9)
sortListByAnother_7 = archilab.Lists.Lists.SortListByAnother(list=sortListByAnother_6.list, sortBy=Y_3)

# group: Get height
firstItem_4 = List.FirstItem(list=sortListByAnother_5.list)
code_block_6 = CodeBlock { "Height"; }
ʳʰʸᵗʰᵐ_elements = Rhythm.Revit.Elements.Elements.GetParameterValueByNameTypeOrInstance(element=firstItem_4, parameterName=code_block_6)
code_block_7 = CodeBlock { 0; }
list_create = List.Create(item0=ʳʰʸᵗʰᵐ_elements, item1=code_block_7)
replaceNull = archilab.Lists.Lists.ReplaceNull(list=list_create, replacement=code_block_7)
sum = Math.Sum(values=replaceNull)
firstItem_5 = List.FirstItem(list=sortListByAnother_3.list)
ʳʰʸᵗʰᵐ_elements_2 = Rhythm.Revit.Elements.Elements.GetParameterValueByNameTypeOrInstance(element=firstItem_5, parameterName=code_block_6)
getLocation_10 = Element.GetLocation(element=firstItem_4)
getLocation_11 = Element.GetLocation(element=firstItem_5)
byStartPointEndPoint = Line.ByStartPointEndPoint(startPoint=getLocation_10, endPoint=getLocation_11)
length = Curve.Length(curve=byStartPointEndPoint)
list_create_2 = List.Create(item0=length, item1=code_block_7)
replaceNull_2 = archilab.Lists.Lists.ReplaceNull(list=list_create_2, replacement=code_block_7)
sum_2 = Math.Sum(values=replaceNull_2)
sub = sum_2 - ʳʰʸᵗʰᵐ_elements_2
list_create_3 = List.Create(item0=sub)
code_block_8 = CodeBlock { 0; }
code_block_9 = CodeBlock { 2; }
mul = ʳʰʸᵗʰᵐ_elements_2 * code_block_9
sub_2 = ʳʰʸᵗʰᵐ_elements_2 - mul
formula = Formula("x=y", y=sub_2)  # unwired: x
replaceByCondition = Replace(item=list_create_3, replaceWith=code_block_8, condition=formula)
code_block_10 = CodeBlock(a=sum, b=ʳʰʸᵗʰᵐ_elements_2, c=replaceByCondition) { a+b+c; }

# group: Family Data
type_2 = archilab.Revit.Elements.Elements.Type(element=window_trim)
parameters_3 = Element.Parameters(element=type_2)
watch_3 = Watch(parameters_3)
parameters_4 = Element.Parameters(element=window_trim)
watch_4 = Watch(parameters_4)

# group: Match Properties
string_from_object_2 = FromObject(object=watch_4)
string = StringInput(":")
lastIndexOf = String.LastIndexOf(string=string_from_object_2, searchFor=string)
length_2 = String.Length(string=string_from_object_2)
sub_3 = length_2 - lastIndexOf
substring = String.Substring(string=string_from_object_2, startIndex=lastIndexOf, length=sub_3)
string_2 = StringInput("")
replace = String.Replace(string=string_from_object_2, searchFor=substring, replaceWith=string_2)
trimTrailingWhitespace = String.TrimTrailingWhitespace(string=replace)
code_block_11 = CodeBlock()
# ---------- code_block_11.designscript (35 lines) ----------
"Area";
"Category";
"Comments";
"Design Option";
"Documentation : https";
"Elevation from Level";
"Export to IFC";
"Export to IFC As";
"Family";
"Family and Type : WTS_Trim_Interior_Window_Flat_Header";
"Family Name";
"Host Id";
"hsbcad Assembly Name";
"hsbcad Beam Code";
"hsbcad Beam Id";
"hsbcad Beam Type";
"hsbcad Element Type";
"hsbcad Item Container Name";
"hsbcad Module";
"hsbcad Panel Number";
"hsbcad Posnum";
"hsbcad Weight";
"IFC Predefined Type";
"IfcGUID";
"Image";
"Level";
"Mark";
"Phase Created";
"Phase Demolished";
"Type";
"Type Id";
"Type Name";
"Volume";
"Window Height";
"Window Width";
# ----------------------------------------
list_create_4 = List.Create(item0=code_block_11.out0, item1=code_block_11.out1, item2=code_block_11.out2, item3=code_block_11.out3, item4=code_block_11.out4, item5=code_block_11.out5, item6=code_block_11.out6, item7=code_block_11.out7, item8=code_block_11.out8, item9=code_block_11.out9, item10=code_block_11.out10, item11=code_block_11.out11, item12=code_block_11.out12, item13=code_block_11.out13, item14=code_block_11.out14, item15=code_block_11.out15, item16=code_block_11.out16, item17=code_block_11.out17, item18=code_block_11.out18, item19=code_block_11.out19, item20=code_block_11.out20, item21=code_block_11.out21, item22=code_block_11.out22, item23=code_block_11.out23, item24=code_block_11.out24, item25=code_block_11.out25, item26=code_block_11.out26, item27=code_block_11.out27, item28=code_block_11.out28, item29=code_block_11.out29, item30=code_block_11.out30, item31=code_block_11.out31, item32=code_block_11.out32, item33=code_block_11.out33, item34=code_block_11.out34)
contains = String.Contains(string=trimTrailingWhitespace, searchFor=list_create_4, lacing=CrossProduct)
anyTrue = Custom[Booleans.AnyTrue](seq=contains)  # package Clockwork for Dynamo 2.x; Returns true if any item in a list of booleans is true. ATTENTION: This node will be deprecated in 2024. As of Revit 2022, please switch to the OOTB node AnyTrue.
filterByBoolMask_5 = List.FilterByBoolMask(list=trimTrailingWhitespace, mask=anyTrue)
watch_5 = Watch(filterByBoolMask_5.out)

getLocation_12 = Element.GetLocation(element=filterByBoolMask.in)
add = _ + _  # unwired: x, y

# group: Window Base Line
getLocation_13 = Element.GetLocation(element=sortListByAnother_3.list)
code_block_12 = CodeBlock { "Width"; }
ʳʰʸᵗʰᵐ_elements_3 = Rhythm.Revit.Elements.Elements.GetParameterValueByNameTypeOrInstance(element=sortListByAnother_3.list, parameterName=code_block_12)
code_block_13 = CodeBlock { 2; }
div = ʳʰʸᵗʰᵐ_elements_3 / code_block_13

# group: Get Vector
element_host_2 = Custom[Element Host](element=sortListByAnother_3.list)
ʳʰʸᵗʰᵐ_hostobject = Rhythm.Revit.Elements.HostObject.ExteriorSurface(hostObject=element_host_2)
tangentAtVParameter = Surface.TangentAtVParameter(surface=ʳʰʸᵗʰᵐ_hostobject)
X_4 = Point.X(point=getLocation_13)
Y_4 = Point.Y(point=getLocation_13)
Z_4 = Point.Z(point=getLocation_13)
byCoordinates = Vector.ByCoordinates(x=X_4, y=Y_4, z=Z_4)
principalDirectionsAtParameter = Surface.PrincipalDirectionsAtParameter(surface=ʳʰʸᵗʰᵐ_hostobject)
lastItem = List.LastItem(list=principalDirectionsAtParameter)

# group (continued): Window Base Line
reverse = Vector.Reverse(vector=tangentAtVParameter)
byStartPointDirectionLength = Line.ByStartPointDirectionLength(startPoint=getLocation_13, direction=reverse, length=div)
byStartPointDirectionLength_2 = Line.ByStartPointDirectionLength(startPoint=getLocation_13, direction=tangentAtVParameter, length=div)
flatten = List.Flatten(list=byStartPointDirectionLength_2)
endPoint = Curve.EndPoint(curve=flatten)
startPoint = Curve.StartPoint(curve=flatten)

flatten_2 = List.Flatten(list=byStartPointDirectionLength)

# group (continued): Window Base Line
startPoint_2 = Curve.StartPoint(curve=flatten_2)
endPoint_2 = Curve.EndPoint(curve=flatten_2)
list_create_5 = List.Create(item0=startPoint_2, item1=endPoint_2, item2=endPoint, item3=startPoint)
flatten_3 = List.Flatten(list=list_create_5)

# group: Trim Width /Trim orgin / Vertical trim ditect
byBestFitThroughPoints = Line.ByBestFitThroughPoints(bestFitPoints=flatten_3)
code_block_14 = CodeBlock { 2; }
pointsAtEqualSegmentLength = Curve.PointsAtEqualSegmentLength(curve=byBestFitThroughPoints, divisions=code_block_14)
length_3 = Curve.Length(curve=byBestFitThroughPoints)
extrude = Curve.Extrude(curve=byBestFitThroughPoints)
extrude_2 = Curve.Extrude(curve=flatten)
difference = Surface.Difference(surface=extrude, others=extrude_2)
extrude_3 = Curve.Extrude(curve=flatten_2)
difference_2 = Surface.Difference(surface=difference, others=extrude_3)
explode = Geometry.Explode(geometry=difference_2)
code_block_15 = CodeBlock { 1/2; }
pointAtParameter = Surface.PointAtParameter(surface=explode, u=code_block_15)
perimeter = Surface.Perimeter(surface=explode)
code_block_16 = CodeBlock { 2; }
round_4 = Math.Round(number=perimeter, digits=code_block_16)
code_block_17 = CodeBlock { 2; }
sub_4 = round_4 - code_block_17
div_2 = sub_4 / code_block_17
firstItem_6 = List.FirstItem(list=div_2)

# group: Point Creator
X_5 = Point.X(point=pointsAtEqualSegmentLength)
Y_5 = Point.Y(point=pointsAtEqualSegmentLength)
Z_5 = Point.Z(point=pointsAtEqualSegmentLength)
code_block_18 = CodeBlock { "Lower Horizontal Trim Width"; }
ʳʰʸᵗʰᵐ_elements_4 = Rhythm.Revit.Elements.Elements.GetParameterValueByNameTypeOrInstance(element=window_trim, parameterName=code_block_18)
code_block_19 = CodeBlock { "Sill Bottom Height"; }
ʳʰʸᵗʰᵐ_elements_5 = Rhythm.Revit.Elements.Elements.GetParameterValueByNameTypeOrInstance(element=window_trim, parameterName=code_block_19)
code_block_20 = CodeBlock { "Sill Thickness"; }
ʳʰʸᵗʰᵐ_elements_6 = Rhythm.Revit.Elements.Elements.GetParameterValueByNameTypeOrInstance(element=window_trim, parameterName=code_block_20)
code_block_21 = CodeBlock { "Bottom Sill Offset"; }
ʳʰʸᵗʰᵐ_elements_7 = Rhythm.Revit.Elements.Elements.GetParameterValueByNameTypeOrInstance(element=window_trim, parameterName=code_block_21)
code_block_22 = CodeBlock { "Bottom Sill Width"; }
ʳʰʸᵗʰᵐ_elements_8 = Rhythm.Revit.Elements.Elements.GetParameterValueByNameTypeOrInstance(element=window_trim, parameterName=code_block_22)
code_block_23 = CodeBlock { "Sill Height"; }
ʳʰʸᵗʰᵐ_elements_9 = Rhythm.Revit.Elements.Elements.GetParameterValueByNameTypeOrInstance(element=window_trim, parameterName=code_block_23)
list_create_6 = List.Create(item0=ʳʰʸᵗʰᵐ_elements_4, item1=ʳʰʸᵗʰᵐ_elements_5, item2=ʳʰʸᵗʰᵐ_elements_6, item3=ʳʰʸᵗʰᵐ_elements_7, item4=ʳʰʸᵗʰᵐ_elements_8, item5=ʳʰʸᵗʰᵐ_elements_9)
string_from_object_3 = FromObject(object=list_create_6)
string_3 = StringInput("")
eq_5 = string_from_object_3 == string_3
filterByBoolMask_6 = List.FilterByBoolMask(list=list_create_6, mask=eq_5)
sum_3 = Math.Sum(values=filterByBoolMask_6.out)
sub_5 = Z_5 - sum_3
byCoordinates_2 = Point.ByCoordinates(x=X_5, y=Y_5, z=sub_5)

# group (continued): Get Trim
byHostAndPoint = FamilyInstance.ByHostAndPoint(familyType=type, host=firstItem, point=byCoordinates_2, lacing=Longest)
setPinnedStatus = Element.SetPinnedStatus(element=byHostAndPoint, pinned=boolean)

# group: Trims Data
code_block_24 = CodeBlock { "Window Height"; }
ʳʰʸᵗʰᵐ_elements_10 = Rhythm.Revit.Elements.Elements.SetParameterByNameTypeOrInstance(element=byHostAndPoint, parameterName=code_block_24, value=code_block_10)
code_block_25 = CodeBlock { "Window Width"; }
ʳʰʸᵗʰᵐ_elements_11 = Rhythm.Revit.Elements.Elements.SetParameterByNameTypeOrInstance(element=byHostAndPoint, parameterName=code_block_25, value=length_3)

# group: Get Vertical Trim
string_4 = StringInput("WTS_Trim_Exterior_Window_Vertical")
byName = Family.ByName(name=string_4)
types = Family.Types(family=byName)
name_2 = Family.Name(family=types)
eq_6 = name_2 == name
filterByBoolMask_7 = List.FilterByBoolMask(list=types, mask=eq_6)
element_host_3 = Custom[Element Host](element=sortListByAnother_3.list)
byHostAndPoint_2 = FamilyInstance.ByHostAndPoint(familyType=filterByBoolMask_7.in, host=element_host_3, point=pointAtParameter, lacing=Longest)
flatten_4 = List.Flatten(list=byHostAndPoint_2)
boolean_2 = BoolSelector(false)
setPinnedStatus_2 = Element.SetPinnedStatus(element=byHostAndPoint_2, pinned=boolean_2)

# group: Vertical Trims Data
code_block_26 = CodeBlock { "Window Height"; }
ʳʰʸᵗʰᵐ_elements_12 = Rhythm.Revit.Elements.Elements.SetParameterByNameTypeOrInstance(element=flatten_4, parameterName=code_block_26, value=code_block_10, lacing=Longest)
code_block_27 = CodeBlock { "Trim Width"; }
ʳʰʸᵗʰᵐ_elements_13 = Rhythm.Revit.Elements.Elements.SetParameterByNameTypeOrInstance(element=flatten_4, parameterName=code_block_27, value=firstItem_6)

# group: Match Type
ʳʰʸᵗʰᵐ_elements_14 = Rhythm.Revit.Elements.Elements.GetParameterValueByNameTypeOrInstance(element=window_trim, parameterName=watch_5)
watch_6 = Watch(ʳʰʸᵗʰᵐ_elements_14)
ʳʰʸᵗʰᵐ_elements_15 = Rhythm.Revit.Elements.Elements.SetParameterByNameTypeOrInstance(element=byHostAndPoint, parameterName=watch_5, value=ʳʰʸᵗʰᵐ_elements_14)
