# Dynamo graph Auto Trims  m v 1.07 .dyn "Auto Trims m v 1.07" (Dynamo 2.16.2.5624)
# author: Yousef Altear
# packages: Rhythm 2023.9.1, archi-lab.net 2024.217.1024, Genius Loci 2023.7.13, GenerativeDesign.Revit 3.0.16.0, Clockwork for Dynamo 2.x 2.6.0

# group: Auto Window Trim
# note: Ⓒ Copyright of Script to Paragons Egypt Team

# group: Get Window
m_w_multiple_window = DSModelElementMutlipleSelection()  # 8 picked in the model; graph input

# group: Get Trim
window_trim = DSModelElementSelection()  # 1 picked in the model; graph input
type = archilab.Revit.Elements.Elements.Type(element=window_trim)
element_host = Custom[Element Host](element=m_w_multiple_window)  # package Genius Loci; Gets the host of the element. Unlike the OOTB node FamilyInstance.GetHost, it also works for elements hosted by a linked document, wall sweeps, foundations, railings and builing pads. Based on a Clockwork's node
firstItem = List.FirstItem(list=element_host)
parameters = Element.Parameters(element=window_trim)
watch = Watch(parameters)
parameters_2 = Element.Parameters(element=type)
watch_2 = Watch(parameters_2)
number = DoubleInput(11)
getItemAtIndex = List.GetItemAtIndex(list=watch_2, index=number)
name = Family.Name(family=window_trim)
boolean = BoolSelector(false)

# group: Sortation
getLocation = Element.GetLocation(element=m_w_multiple_window)
Z = Point.Z(point=getLocation)
code_block = CodeBlock { 2; }
round = Math.Round(number=Z, digits=code_block)
sortIndexByValue = List.SortIndexByValue(list=round)
sortListByAnother = archilab.Lists.Lists.SortListByAnother(list=m_w_multiple_window, sortBy=sortIndexByValue)
getLocation_2 = Element.GetLocation(element=m_w_multiple_window)
Z_2 = Point.Z(point=getLocation_2)
firstItem_2 = List.FirstItem(list=Z_2)
eq = Z_2 == firstItem_2
filterByBoolMask = List.FilterByBoolMask(list=sortListByAnother.list, mask=eq)
getLocation_3 = Element.GetLocation(element=filterByBoolMask.in)
Y = Point.Y(point=getLocation_3)
code_block_2 = CodeBlock { 2; }
round_2 = Math.Round(number=Y, digits=code_block_2)
sortIndexByValue_2 = List.SortIndexByValue(list=round_2)
sortListByAnother_2 = archilab.Lists.Lists.SortListByAnother(list=filterByBoolMask.in, sortBy=sortIndexByValue_2)
getLocation_4 = Element.GetLocation(element=sortListByAnother_2.list)
X = Point.X(point=getLocation_4)
code_block_3 = CodeBlock { 2; }
round_3 = Math.Round(number=X, digits=code_block_3)
sortIndexByValue_3 = List.SortIndexByValue(list=round_3)
sortListByAnother_3 = archilab.Lists.Lists.SortListByAnother(list=sortListByAnother_2.list, sortBy=sortIndexByValue_3)
getLocation_5 = Element.GetLocation(element=filterByBoolMask.out)
Z_3 = Point.Z(point=getLocation_5)
firstItem_3 = List.FirstItem(list=Z_3)
eq_2 = firstItem_3 == Z_3
filterByBoolMask_2 = List.FilterByBoolMask(list=filterByBoolMask.out, mask=eq_2)
getLocation_6 = Element.GetLocation(element=filterByBoolMask_2.in)
X_2 = Point.X(point=getLocation_6)
sortListByAnother_4 = archilab.Lists.Lists.SortListByAnother(list=filterByBoolMask_2.in, sortBy=X_2)
getLocation_7 = Element.GetLocation(element=sortListByAnother_4.list)
Y_2 = Point.Y(point=getLocation_7)
sortListByAnother_5 = archilab.Lists.Lists.SortListByAnother(list=sortListByAnother_4.list, sortBy=Y_2)
getLocation_8 = Element.GetLocation(element=filterByBoolMask_2.out)
X_3 = Point.X(point=getLocation_8)
sortListByAnother_6 = archilab.Lists.Lists.SortListByAnother(list=filterByBoolMask_2.out, sortBy=X_3)
getLocation_9 = Element.GetLocation(element=sortListByAnother_6.list)
Y_3 = Point.Y(point=getLocation_9)
sortListByAnother_7 = archilab.Lists.Lists.SortListByAnother(list=sortListByAnother_6.list, sortBy=Y_3)

# group: Get height
firstItem_4 = List.FirstItem(list=sortListByAnother_5.list)
code_block_4 = CodeBlock { "Height"; }
ʳʰʸᵗʰᵐ_elements = Rhythm.Revit.Elements.Elements.GetParameterValueByNameTypeOrInstance(element=firstItem_4, parameterName=code_block_4)
code_block_5 = CodeBlock { 0; }
list_create = List.Create(item0=ʳʰʸᵗʰᵐ_elements, item1=code_block_5)
replaceNull = archilab.Lists.Lists.ReplaceNull(list=list_create, replacement=code_block_5)
sum = Math.Sum(values=replaceNull)
firstItem_5 = List.FirstItem(list=sortListByAnother_3.list)
ʳʰʸᵗʰᵐ_elements_2 = Rhythm.Revit.Elements.Elements.GetParameterValueByNameTypeOrInstance(element=firstItem_5, parameterName=code_block_4)
getLocation_10 = Element.GetLocation(element=firstItem_4)
getLocation_11 = Element.GetLocation(element=firstItem_5)
byStartPointEndPoint = Line.ByStartPointEndPoint(startPoint=getLocation_10, endPoint=getLocation_11)
length = Curve.Length(curve=byStartPointEndPoint)
list_create_2 = List.Create(item0=length, item1=code_block_5)
replaceNull_2 = archilab.Lists.Lists.ReplaceNull(list=list_create_2, replacement=code_block_5)
sum_2 = Math.Sum(values=replaceNull_2)
sub = sum_2 - ʳʰʸᵗʰᵐ_elements_2
list_create_3 = List.Create(item0=sub)
code_block_6 = CodeBlock { 0; }
code_block_7 = CodeBlock { 2; }
mul = ʳʰʸᵗʰᵐ_elements_2 * code_block_7
sub_2 = ʳʰʸᵗʰᵐ_elements_2 - mul
formula = Formula("x=y", y=sub_2)  # unwired: x
replaceByCondition = Replace(item=list_create_3, replaceWith=code_block_6, condition=formula)
code_block_8 = CodeBlock(a=sum, b=ʳʰʸᵗʰᵐ_elements_2, c=replaceByCondition) { a+b+c; }

# group: Family Data
type_2 = archilab.Revit.Elements.Elements.Type(element=window_trim)
parameters_3 = Element.Parameters(element=type_2)
watch_3 = Watch(parameters_3)
parameters_4 = Element.Parameters(element=window_trim)
watch_4 = Watch(parameters_4)

# group: Match Properties
string_from_object = FromObject(object=watch_4)
string = StringInput(":")
lastIndexOf = String.LastIndexOf(string=string_from_object, searchFor=string)
length_2 = String.Length(string=string_from_object)
sub_3 = length_2 - lastIndexOf
substring = String.Substring(string=string_from_object, startIndex=lastIndexOf, length=sub_3)
string_2 = StringInput("")
replace = String.Replace(string=string_from_object, searchFor=substring, replaceWith=string_2)
trimTrailingWhitespace = String.TrimTrailingWhitespace(string=replace)
code_block_9 = CodeBlock()
# ---------- code_block_9.designscript (35 lines) ----------
"Area";
"Category";
"Comments";
"Design Option";
"Documentation : https";
"Elevation from Level";
"Export to IFC";
"Export to IFC As";
"Family";
"Family and Type : WTS_Trim_Interior_Window_Flat_Header";
"Family Name";
"Host Id";
"hsbcad Assembly Name";
"hsbcad Beam Code";
"hsbcad Beam Id";
"hsbcad Beam Type";
"hsbcad Element Type";
"hsbcad Item Container Name";
"hsbcad Module";
"hsbcad Panel Number";
"hsbcad Posnum";
"hsbcad Weight";
"IFC Predefined Type";
"IfcGUID";
"Image";
"Level";
"Mark";
"Phase Created";
"Phase Demolished";
"Type";
"Type Id";
"Type Name";
"Volume";
"Window Height";
"Window Width";
# ----------------------------------------
list_create_4 = List.Create(item0=code_block_9.out0, item1=code_block_9.out1, item2=code_block_9.out2, item3=code_block_9.out3, item4=code_block_9.out4, item5=code_block_9.out5, item6=code_block_9.out6, item7=code_block_9.out7, item8=code_block_9.out8, item9=code_block_9.out9, item10=code_block_9.out10, item11=code_block_9.out11, item12=code_block_9.out12, item13=code_block_9.out13, item14=code_block_9.out14, item15=code_block_9.out15, item16=code_block_9.out16, item17=code_block_9.out17, item18=code_block_9.out18, item19=code_block_9.out19, item20=code_block_9.out20, item21=code_block_9.out21, item22=code_block_9.out22, item23=code_block_9.out23, item24=code_block_9.out24, item25=code_block_9.out25, item26=code_block_9.out26, item27=code_block_9.out27, item28=code_block_9.out28, item29=code_block_9.out29, item30=code_block_9.out30, item31=code_block_9.out31, item32=code_block_9.out32, item33=code_block_9.out33, item34=code_block_9.out34)
contains = String.Contains(string=trimTrailingWhitespace, searchFor=list_create_4, lacing=CrossProduct)
anyTrue = Custom[Booleans.AnyTrue](seq=contains)  # package Clockwork for Dynamo 2.x; Returns true if any item in a list of booleans is true. ATTENTION: This node will be deprecated in 2024. As of Revit 2022, please switch to the OOTB node AnyTrue.
filterByBoolMask_3 = List.FilterByBoolMask(list=trimTrailingWhitespace, mask=anyTrue)
watch_5 = Watch(filterByBoolMask_3.out)

getLocation_12 = Element.GetLocation(element=m_w_multiple_window)
m_w_multiple_window_2 = DSModelElementMutlipleSelection()  # 4 picked in the model; graph input

# group: Get Row of Windows
getLocation_13 = Element.GetLocation(element=m_w_multiple_window_2)
Y_4 = Point.Y(point=getLocation_13)
code_block_10 = CodeBlock { 2; }
round_4 = Math.Round(number=Y_4, digits=code_block_10)
firstItem_6 = List.FirstItem(list=round_4)
eq_3 = round_4 == firstItem_6
filterByBoolMask_4 = List.FilterByBoolMask(list=m_w_multiple_window_2, mask=eq_3)
getLocation_14 = Element.GetLocation(element=filterByBoolMask_4.in)
X_4 = Point.X(point=getLocation_14)
code_block_11 = CodeBlock { 2; }
round_5 = Math.Round(number=X_4, digits=code_block_11)
firstItem_7 = List.FirstItem(list=round_5)
eq_4 = round_5 == firstItem_7
filterByBoolMask_5 = List.FilterByBoolMask(list=filterByBoolMask_4.in, mask=eq_4)

# group: Get Vector
X_5 = Point.X(point=getLocation_13)
Y_5 = Point.Y(point=getLocation_13)
Z_4 = Point.Z(point=getLocation_13)
byCoordinates = Vector.ByCoordinates(x=X_5, y=Y_5, z=Z_4)
element_host_2 = Custom[Element Host](element=m_w_multiple_window_2)
ʳʰʸᵗʰᵐ_hostobject = Rhythm.Revit.Elements.HostObject.ExteriorSurface(hostObject=element_host_2)
principalDirectionsAtParameter = Surface.PrincipalDirectionsAtParameter(surface=ʳʰʸᵗʰᵐ_hostobject)
lastItem = List.LastItem(list=principalDirectionsAtParameter)
tangentAtUParameter = Surface.TangentAtUParameter(surface=ʳʰʸᵗʰᵐ_hostobject)
tangentAtVParameter = Surface.TangentAtVParameter(surface=ʳʰʸᵗʰᵐ_hostobject)
firstItem_8 = List.FirstItem(list=tangentAtVParameter)

add = _ + _  # unwired: x, y

# group: Window Side Line
getLocation_15 = Element.GetLocation(element=filterByBoolMask_5.in)
reverse = Vector.Reverse(vector=tangentAtUParameter)
code_block_12 = CodeBlock { "Height"; }
ʳʰʸᵗʰᵐ_elements_3 = Rhythm.Revit.Elements.Elements.GetParameterValueByNameTypeOrInstance(element=m_w_multiple_window_2, parameterName=code_block_12)
byStartPointDirectionLength = Line.ByStartPointDirectionLength(startPoint=getLocation_15, direction=reverse, length=ʳʰʸᵗʰᵐ_elements_3)
startPoint = Curve.StartPoint(curve=byStartPointDirectionLength)
endPoint = Curve.EndPoint(curve=byStartPointDirectionLength)
list_create_5 = List.Create(item0=startPoint, item1=endPoint)
flatten = List.Flatten(list=list_create_5)
flatten_2 = List.Flatten(list=byStartPointDirectionLength)

# group: Window Base Line
getLocation_16 = Element.GetLocation(element=sortListByAnother_3.list)
code_block_13 = CodeBlock { "Width"; }
ʳʰʸᵗʰᵐ_elements_4 = Rhythm.Revit.Elements.Elements.GetParameterValueByNameTypeOrInstance(element=sortListByAnother_3.list, parameterName=code_block_13)
code_block_14 = CodeBlock { 2; }
div = ʳʰʸᵗʰᵐ_elements_4 / code_block_14

# group: Get Vector
element_host_3 = Custom[Element Host](element=sortListByAnother_3.list)
ʳʰʸᵗʰᵐ_hostobject_2 = Rhythm.Revit.Elements.HostObject.ExteriorSurface(hostObject=element_host_3)
tangentAtVParameter_2 = Surface.TangentAtVParameter(surface=ʳʰʸᵗʰᵐ_hostobject_2)
X_6 = Point.X(point=getLocation_16)
Y_6 = Point.Y(point=getLocation_16)
Z_5 = Point.Z(point=getLocation_16)
byCoordinates_2 = Vector.ByCoordinates(x=X_6, y=Y_6, z=Z_5)
principalDirectionsAtParameter_2 = Surface.PrincipalDirectionsAtParameter(surface=ʳʰʸᵗʰᵐ_hostobject_2)
lastItem_2 = List.LastItem(list=principalDirectionsAtParameter_2)

# group (continued): Window Base Line
reverse_2 = Vector.Reverse(vector=tangentAtVParameter_2)
byStartPointDirectionLength_2 = Line.ByStartPointDirectionLength(startPoint=getLocation_16, direction=reverse_2, length=div)
byStartPointDirectionLength_3 = Line.ByStartPointDirectionLength(startPoint=getLocation_16, direction=tangentAtVParameter_2, length=div)
flatten_3 = List.Flatten(list=byStartPointDirectionLength_3)
endPoint_2 = Curve.EndPoint(curve=flatten_3)
startPoint_2 = Curve.StartPoint(curve=flatten_3)

flatten_4 = List.Flatten(list=byStartPointDirectionLength_2)

# group (continued): Window Base Line
startPoint_3 = Curve.StartPoint(curve=flatten_4)
endPoint_3 = Curve.EndPoint(curve=flatten_4)
list_create_6 = List.Create(item0=startPoint_3, item1=endPoint_3, item2=endPoint_2, item3=startPoint_2)
flatten_5 = List.Flatten(list=list_create_6)

# group: Trim Window Width /Trim orgin / Vertical trim ditect
byBestFitThroughPoints = Line.ByBestFitThroughPoints(bestFitPoints=flatten_5)
code_block_15 = CodeBlock { 2; }
pointsAtEqualSegmentLength = Curve.PointsAtEqualSegmentLength(curve=byBestFitThroughPoints, divisions=code_block_15)
length_3 = Curve.Length(curve=byBestFitThroughPoints)
extrude = Curve.Extrude(curve=byBestFitThroughPoints)
extrude_2 = Curve.Extrude(curve=flatten_3)
difference = Surface.Difference(surface=extrude, others=extrude_2)
extrude_3 = Curve.Extrude(curve=flatten_4)
difference_2 = Surface.Difference(surface=difference, others=extrude_3)
explode = Geometry.Explode(geometry=difference_2)
code_block_16 = CodeBlock { 1/2; }
pointAtParameter = Surface.PointAtParameter(surface=explode, u=code_block_16)
count = List.Count(list=pointAtParameter)
chop = List.Chop(list=pointAtParameter, lengths=count)
perimeter = Surface.Perimeter(surface=explode)
code_block_17 = CodeBlock { 2; }
round_6 = Math.Round(number=perimeter, digits=code_block_17)
code_block_18 = CodeBlock { 2; }
sub_4 = round_6 - code_block_18
div_2 = sub_4 / code_block_18

# group: Point Creator
X_7 = Point.X(point=pointsAtEqualSegmentLength)
Y_7 = Point.Y(point=pointsAtEqualSegmentLength)
Z_6 = Point.Z(point=pointsAtEqualSegmentLength)
code_block_19 = CodeBlock { "Lower Horizontal Trim Width"; }
ʳʰʸᵗʰᵐ_elements_5 = Rhythm.Revit.Elements.Elements.GetParameterValueByNameTypeOrInstance(element=window_trim, parameterName=code_block_19)
code_block_20 = CodeBlock { "Sill Bottom Height"; }
ʳʰʸᵗʰᵐ_elements_6 = Rhythm.Revit.Elements.Elements.GetParameterValueByNameTypeOrInstance(element=window_trim, parameterName=code_block_20)
code_block_21 = CodeBlock { "Sill Thickness"; }
ʳʰʸᵗʰᵐ_elements_7 = Rhythm.Revit.Elements.Elements.GetParameterValueByNameTypeOrInstance(element=window_trim, parameterName=code_block_21)
code_block_22 = CodeBlock { "Bottom Sill Offset"; }
ʳʰʸᵗʰᵐ_elements_8 = Rhythm.Revit.Elements.Elements.GetParameterValueByNameTypeOrInstance(element=window_trim, parameterName=code_block_22)
code_block_23 = CodeBlock { "Bottom Sill Width"; }
ʳʰʸᵗʰᵐ_elements_9 = Rhythm.Revit.Elements.Elements.GetParameterValueByNameTypeOrInstance(element=window_trim, parameterName=code_block_23)
code_block_24 = CodeBlock { "Sill Height"; }
ʳʰʸᵗʰᵐ_elements_10 = Rhythm.Revit.Elements.Elements.GetParameterValueByNameTypeOrInstance(element=window_trim, parameterName=code_block_24)
list_create_7 = List.Create(item0=ʳʰʸᵗʰᵐ_elements_5, item1=ʳʰʸᵗʰᵐ_elements_6, item2=ʳʰʸᵗʰᵐ_elements_7, item3=ʳʰʸᵗʰᵐ_elements_8, item4=ʳʰʸᵗʰᵐ_elements_9, item5=ʳʰʸᵗʰᵐ_elements_10)
string_from_object_2 = FromObject(object=list_create_7)
string_3 = StringInput("")
eq_5 = string_from_object_2 == string_3
filterByBoolMask_6 = List.FilterByBoolMask(list=list_create_7, mask=eq_5)
sum_3 = Math.Sum(values=filterByBoolMask_6.out)
sub_5 = Z_6 - sum_3
byCoordinates_3 = Point.ByCoordinates(x=X_7, y=Y_7, z=sub_5)

# group (continued): Get Trim
byHostAndPoint = FamilyInstance.ByHostAndPoint(familyType=type, host=firstItem, point=byCoordinates_3, lacing=Longest)
setPinnedStatus = Element.SetPinnedStatus(element=byHostAndPoint, pinned=boolean)

# group: Trims Data
code_block_25 = CodeBlock { "Window Height"; }
ʳʰʸᵗʰᵐ_elements_11 = Rhythm.Revit.Elements.Elements.SetParameterByNameTypeOrInstance(element=byHostAndPoint, parameterName=code_block_25, value=code_block_8)
code_block_26 = CodeBlock { "Window Width"; }
ʳʰʸᵗʰᵐ_elements_12 = Rhythm.Revit.Elements.Elements.SetParameterByNameTypeOrInstance(element=byHostAndPoint, parameterName=code_block_26, value=length_3)

# group: Match Type
ʳʰʸᵗʰᵐ_elements_13 = Rhythm.Revit.Elements.Elements.GetParameterValueByNameTypeOrInstance(element=window_trim, parameterName=watch_5)
watch_6 = Watch(ʳʰʸᵗʰᵐ_elements_13)
ʳʰʸᵗʰᵐ_elements_14 = Rhythm.Revit.Elements.Elements.SetParameterByNameTypeOrInstance(element=byHostAndPoint, parameterName=watch_5, value=ʳʰʸᵗʰᵐ_elements_13)

# group: Translate X
Z_7 = Point.Z(point=pointsAtEqualSegmentLength)
Z_8 = Point.Z(point=flatten)
eq_6 = Z_7 == Z_8  # lacing=Longest
filterByBoolMask_7 = List.FilterByBoolMask(list=flatten, mask=eq_6)
byStartPointEndPoint_2 = Line.ByStartPointEndPoint(startPoint=pointsAtEqualSegmentLength, endPoint=filterByBoolMask_7.in)
length_4 = Curve.Length(curve=byStartPointEndPoint_2)
code_block_27 = CodeBlock(x=length_4) { -x; }

# group: Trim Height / Horizontal trim ditect
byBestFitThroughPoints_2 = Line.ByBestFitThroughPoints(bestFitPoints=flatten)
translate = Geometry.Translate(geometry=byBestFitThroughPoints_2, direction=firstItem_8, distance=code_block_27)
extrude_4 = Curve.Extrude(curve=translate, direction=firstItem_8)
translate_2 = Geometry.Translate(geometry=flatten_2, direction=firstItem_8, distance=code_block_27, lacing=Longest)
extrude_5 = Curve.Extrude(curve=translate_2, direction=firstItem_8, lacing=Longest)
flatten_6 = List.Flatten(list=extrude_5)
difference_3 = Surface.Difference(surface=extrude_4, others=flatten_6)
explode_2 = Geometry.Explode(geometry=difference_3)
code_block_28 = CodeBlock { 0; }
code_block_29 = CodeBlock { 0; }
pointAtParameter_2 = Surface.PointAtParameter(surface=explode_2, u=code_block_28, v=code_block_29)

# group: Get Vertical / Horizontal Trim
string_4 = StringInput("WTS_Trim_Exterior_Window_Vertical")
byName = Family.ByName(name=string_4)
types = Family.Types(family=byName)
name_2 = Family.Name(family=types)
eq_7 = name_2 == name
filterByBoolMask_8 = List.FilterByBoolMask(list=types, mask=eq_7)
element_host_4 = Custom[Element Host](element=sortListByAnother_3.list)
byHostAndPoint_2 = FamilyInstance.ByHostAndPoint(familyType=filterByBoolMask_8.in, host=element_host_4, point=chop)
flatten_7 = List.Flatten(list=byHostAndPoint_2)
boolean_2 = BoolSelector(false)
setPinnedStatus_2 = Element.SetPinnedStatus(element=byHostAndPoint_2, pinned=boolean_2)
byHostAndPoint_3 = FamilyInstance.ByHostAndPoint(familyType=filterByBoolMask_8.in, host=element_host_4, point=pointAtParameter_2)

# group: Vertical Trims Data
code_block_30 = CodeBlock { "Window Height"; }
ʳʰʸᵗʰᵐ_elements_15 = Rhythm.Revit.Elements.Elements.SetParameterByNameTypeOrInstance(element=flatten_7, parameterName=code_block_30, value=code_block_8, lacing=Longest)
code_block_31 = CodeBlock { "Trim Width"; }
ʳʰʸᵗʰᵐ_elements_16 = Rhythm.Revit.Elements.Elements.SetParameterByNameTypeOrInstance(element=flatten_7, parameterName=code_block_31, value=div_2)
