# Dynamo graph Auto Trims  m v 1.31.dyn "Auto Trims m v 1.3" (Dynamo 2.16.2.5624)
# author: Yousef Altear
# packages: Rhythm 2023.9.1, archi-lab.net 2024.217.1024, Genius Loci 2023.7.13, GenerativeDesign.Revit 3.0.16.0, Clockwork for Dynamo 2.x 2.6.0

# group: Auto Window Trim
# note: Ⓒ Copyright of Script to Paragons Egypt Team

# group: Get Window
m_w_multiple_window = DSModelElementMutlipleSelection()  # 3 picked in the model; graph input

# group: Get Trim
window_trim = DSModelElementSelection()  # 1 picked in the model; graph input
type = archilab.Revit.Elements.Elements.Type(element=window_trim)
element_host = Custom[Element Host](element=m_w_multiple_window)  # package Genius Loci; Gets the host of the element. Unlike the OOTB node FamilyInstance.GetHost, it also works for elements hosted by a linked document, wall sweeps, foundations, railings and builing pads. Based on a Clockwork's node
firstItem = List.FirstItem(list=element_host)
parameters = Element.Parameters(element=window_trim)
watch = Watch(parameters)
parameters_2 = Element.Parameters(element=type)
watch_2 = Watch(parameters_2)
name = Family.Name(family=window_trim)
boolean = BoolSelector(false)
element_host_2 = Custom[Element Host](element=window_trim)

# group: Sortation
getLocation = Element.GetLocation(element=m_w_multiple_window)
Z = Point.Z(point=getLocation)
sort = List.Sort(list=Z)
firstItem_2 = List.FirstItem(list=sort)
eq = Z == firstItem_2
filterByBoolMask = List.FilterByBoolMask(list=m_w_multiple_window, mask=eq)
getLocation_2 = Element.GetLocation(element=filterByBoolMask.in)
Y = Point.Y(point=getLocation_2)
code_block = CodeBlock { 2; }
round = Math.Round(number=Y, digits=code_block)
sortIndexByValue = List.SortIndexByValue(list=round)
sortListByAnother = archilab.Lists.Lists.SortListByAnother(list=filterByBoolMask.in, sortBy=sortIndexByValue)
getLocation_3 = Element.GetLocation(element=sortListByAnother.list)
X = Point.X(point=getLocation_3)
code_block_2 = CodeBlock { 2; }
round_2 = Math.Round(number=X, digits=code_block_2)
sortIndexByValue_2 = List.SortIndexByValue(list=round_2)
sortListByAnother_2 = archilab.Lists.Lists.SortListByAnother(list=sortListByAnother.list, sortBy=sortIndexByValue_2)
Z_2 = Point.Z(point=getLocation)

# group: Get Row of Windows
getLocation_4 = Element.GetLocation(element=m_w_multiple_window)
Y_2 = Point.Y(point=getLocation_4)
code_block_3 = CodeBlock { 2; }
round_3 = Math.Round(number=Y_2, digits=code_block_3)
firstItem_3 = List.FirstItem(list=round_3)
eq_2 = round_3 == firstItem_3
filterByBoolMask_2 = List.FilterByBoolMask(list=m_w_multiple_window, mask=eq_2)
getLocation_5 = Element.GetLocation(element=filterByBoolMask_2.in)
X_2 = Point.X(point=getLocation_5)
code_block_4 = CodeBlock { 2; }
round_4 = Math.Round(number=X_2, digits=code_block_4)
firstItem_4 = List.FirstItem(list=round_4)
eq_3 = round_4 == firstItem_4
filterByBoolMask_3 = List.FilterByBoolMask(list=filterByBoolMask_2.in, mask=eq_3)
count = List.Count(list=filterByBoolMask_3.out)

# group: Get Vector
element_host_3 = Custom[Element Host](element=m_w_multiple_window)
ʳʰʸᵗʰᵐ_hostobject = Rhythm.Revit.Elements.HostObject.ExteriorSurface(hostObject=element_host_3)
tangentAtUParameter = Surface.TangentAtUParameter(surface=ʳʰʸᵗʰᵐ_hostobject)
tangentAtVParameter = Surface.TangentAtVParameter(surface=ʳʰʸᵗʰᵐ_hostobject)
firstItem_5 = List.FirstItem(list=tangentAtVParameter)
reverse = Vector.Reverse(vector=firstItem_5)

# group: Window Side Line
getLocation_6 = Element.GetLocation(element=filterByBoolMask_3.in)
reverse_2 = Vector.Reverse(vector=tangentAtUParameter)
X_3 = Vector.X(vector=reverse_2)
Y_3 = Vector.Y(vector=reverse_2)
Z_3 = Vector.Z(vector=reverse_2)
abs = Math.Abs(number=Z_3)
byCoordinates = Vector.ByCoordinates(x=X_3, y=Y_3, z=abs)
code_block_5 = CodeBlock { "Height"; }
ʳʰʸᵗʰᵐ_elements = Rhythm.Revit.Elements.Elements.GetParameterValueByNameTypeOrInstance(element=filterByBoolMask_3.in, parameterName=code_block_5)
byStartPointDirectionLength = Line.ByStartPointDirectionLength(startPoint=getLocation_6, direction=byCoordinates, length=ʳʰʸᵗʰᵐ_elements)
flatten = List.Flatten(list=byStartPointDirectionLength)
startPoint = Curve.StartPoint(curve=flatten)
endPoint = Curve.EndPoint(curve=flatten)
list_create = List.Create(item0=startPoint, item1=endPoint)
flatten_2 = List.Flatten(list=list_create)
flatten_3 = List.Flatten(list=byStartPointDirectionLength)

# group: Family Data
type_2 = archilab.Revit.Elements.Elements.Type(element=window_trim)
parameters_3 = Element.Parameters(element=type_2)
watch_3 = Watch(parameters_3)
parameters_4 = Element.Parameters(element=window_trim)
watch_4 = Watch(parameters_4)

# group: Match Properties
string_from_object = FromObject(object=watch_4)
string = StringInput(":")
lastIndexOf = String.LastIndexOf(string=string_from_object, searchFor=string)
length = String.Length(string=string_from_object)
sub = length - lastIndexOf
substring = String.Substring(string=string_from_object, startIndex=lastIndexOf, length=sub)
string_2 = StringInput("")
replace = String.Replace(string=string_from_object, searchFor=substring, replaceWith=string_2)
trimTrailingWhitespace = String.TrimTrailingWhitespace(string=replace)
code_block_6 = CodeBlock()
# ---------- code_block_6.designscript (35 lines) ----------
"Area";
"Category";
"Comments";
"Design Option";
"Documentation : https";
"Elevation from Level";
"Export to IFC";
"Export to IFC As";
"Family";
"Family and Type : WTS_Trim_Interior_Window_Flat_Header";
"Family Name";
"Host Id";
"hsbcad Assembly Name";
"hsbcad Beam Code";
"hsbcad Beam Id";
"hsbcad Beam Type";
"hsbcad Element Type";
"hsbcad Item Container Name";
"hsbcad Module";
"hsbcad Panel Number";
"hsbcad Posnum";
"hsbcad Weight";
"IFC Predefined Type";
"IfcGUID";
"Image";
"Level";
"Mark";
"Phase Created";
"Phase Demolished";
"Type";
"Type Id";
"Type Name";
"Volume";
"Window Height";
"Window Width";
# ----------------------------------------
list_create_2 = List.Create(item0=code_block_6.out0, item1=code_block_6.out1, item2=code_block_6.out2, item3=code_block_6.out3, item4=code_block_6.out4, item5=code_block_6.out5, item6=code_block_6.out6, item7=code_block_6.out7, item8=code_block_6.out8, item9=code_block_6.out9, item10=code_block_6.out10, item11=code_block_6.out11, item12=code_block_6.out12, item13=code_block_6.out13, item14=code_block_6.out14, item15=code_block_6.out15, item16=code_block_6.out16, item17=code_block_6.out17, item18=code_block_6.out18, item19=code_block_6.out19, item20=code_block_6.out20, item21=code_block_6.out21, item22=code_block_6.out22, item23=code_block_6.out23, item24=code_block_6.out24, item25=code_block_6.out25, item26=code_block_6.out26, item27=code_block_6.out27, item28=code_block_6.out28, item29=code_block_6.out29, item30=code_block_6.out30, item31=code_block_6.out31, item32=code_block_6.out32, item33=code_block_6.out33, item34=code_block_6.out34)
contains = String.Contains(string=trimTrailingWhitespace, searchFor=list_create_2, lacing=CrossProduct)
anyTrue = Custom[Booleans.AnyTrue](seq=contains)  # package Clockwork for Dynamo 2.x; Returns true if any item in a list of booleans is true. ATTENTION: This node will be deprecated in 2024. As of Revit 2022, please switch to the OOTB node AnyTrue.
filterByBoolMask_4 = List.FilterByBoolMask(list=trimTrailingWhitespace, mask=anyTrue)
watch_5 = Watch(filterByBoolMask_4.out)

# group: Thickness of Secondary Trims
code_block_7 = CodeBlock { "Trim Thickness"; }
ʳʰʸᵗʰᵐ_elements_2 = Rhythm.Revit.Elements.Elements.GetParameterValueByNameTypeOrInstance(element=window_trim, parameterName=code_block_7)
code_block_8 = CodeBlock { 2; }
round_5 = Math.Round(number=ʳʰʸᵗʰᵐ_elements_2, digits=code_block_8)
code_block_9 = CodeBlock { 0.01; }
sub_2 = round_5 - code_block_9

# group: Window Base Line
getLocation_7 = Element.GetLocation(element=sortListByAnother_2.list)
code_block_10 = CodeBlock { "Width"; }
ʳʰʸᵗʰᵐ_elements_3 = Rhythm.Revit.Elements.Elements.GetParameterValueByNameTypeOrInstance(element=sortListByAnother_2.list, parameterName=code_block_10)
code_block_11 = CodeBlock { 2; }
div = ʳʰʸᵗʰᵐ_elements_3 / code_block_11

# group: Get Vector
element_host_4 = Custom[Element Host](element=sortListByAnother_2.list)
ʳʰʸᵗʰᵐ_hostobject_2 = Rhythm.Revit.Elements.HostObject.ExteriorSurface(hostObject=element_host_4)
tangentAtVParameter_2 = Surface.TangentAtVParameter(surface=ʳʰʸᵗʰᵐ_hostobject_2)
X_4 = Point.X(point=getLocation_7)
Y_4 = Point.Y(point=getLocation_7)
Z_4 = Point.Z(point=getLocation_7)
byCoordinates_2 = Vector.ByCoordinates(x=X_4, y=Y_4, z=Z_4)
principalDirectionsAtParameter = Surface.PrincipalDirectionsAtParameter(surface=ʳʰʸᵗʰᵐ_hostobject_2)
lastItem = List.LastItem(list=principalDirectionsAtParameter)

# group (continued): Window Base Line
reverse_3 = Vector.Reverse(vector=tangentAtVParameter_2)
byStartPointDirectionLength_2 = Line.ByStartPointDirectionLength(startPoint=getLocation_7, direction=reverse_3, length=div)
flatten_4 = List.Flatten(list=byStartPointDirectionLength_2)
startPoint_2 = Curve.StartPoint(curve=flatten_4)
endPoint_2 = Curve.EndPoint(curve=flatten_4)
byStartPointDirectionLength_3 = Line.ByStartPointDirectionLength(startPoint=getLocation_7, direction=tangentAtVParameter_2, length=div)
flatten_5 = List.Flatten(list=byStartPointDirectionLength_3)
endPoint_3 = Curve.EndPoint(curve=flatten_5)
startPoint_3 = Curve.StartPoint(curve=flatten_5)
list_create_3 = List.Create(item0=startPoint_2, item1=endPoint_2, item2=endPoint_3, item3=startPoint_3)
flatten_6 = List.Flatten(list=list_create_3)

# group: Trim Window Width /Trim orgin / Vertical trim ditect
byBestFitThroughPoints = Line.ByBestFitThroughPoints(bestFitPoints=flatten_6)
code_block_12 = CodeBlock { 2; }
pointsAtEqualSegmentLength = Curve.PointsAtEqualSegmentLength(curve=byBestFitThroughPoints, divisions=code_block_12)
length_2 = Curve.Length(curve=byBestFitThroughPoints)
extrude = Curve.Extrude(curve=byBestFitThroughPoints)
extrude_2 = Curve.Extrude(curve=flatten_5)
difference = Surface.Difference(surface=extrude, others=extrude_2)
extrude_3 = Curve.Extrude(curve=flatten_4)
difference_2 = Surface.Difference(surface=difference, others=extrude_3)
explode = Geometry.Explode(geometry=difference_2)
code_block_13 = CodeBlock { 1/2; }
pointAtParameter = Surface.PointAtParameter(surface=explode, u=code_block_13)
count_2 = List.Count(list=pointAtParameter)
chop = List.Chop(list=pointAtParameter, lengths=count_2)
perimeter = Surface.Perimeter(surface=explode)
code_block_14 = CodeBlock { 2; }
round_6 = Math.Round(number=perimeter, digits=code_block_14)
code_block_15 = CodeBlock { 2; }
sub_3 = round_6 - code_block_15
div_2 = sub_3 / code_block_15

# group: Point Creator
X_5 = Point.X(point=pointsAtEqualSegmentLength)
Y_5 = Point.Y(point=pointsAtEqualSegmentLength)
Z_5 = Point.Z(point=pointsAtEqualSegmentLength)
code_block_16 = CodeBlock { "Lower Horizontal Trim Width"; }
ʳʰʸᵗʰᵐ_elements_4 = Rhythm.Revit.Elements.Elements.GetParameterValueByNameTypeOrInstance(element=window_trim, parameterName=code_block_16)
code_block_17 = CodeBlock { "Sill Bottom Height"; }
ʳʰʸᵗʰᵐ_elements_5 = Rhythm.Revit.Elements.Elements.GetParameterValueByNameTypeOrInstance(element=window_trim, parameterName=code_block_17)
code_block_18 = CodeBlock { "Sill Thickness"; }
ʳʰʸᵗʰᵐ_elements_6 = Rhythm.Revit.Elements.Elements.GetParameterValueByNameTypeOrInstance(element=window_trim, parameterName=code_block_18)
code_block_19 = CodeBlock { "Bottom Sill Offset"; }
ʳʰʸᵗʰᵐ_elements_7 = Rhythm.Revit.Elements.Elements.GetParameterValueByNameTypeOrInstance(element=window_trim, parameterName=code_block_19)
code_block_20 = CodeBlock { "Bottom Sill Width"; }
ʳʰʸᵗʰᵐ_elements_8 = Rhythm.Revit.Elements.Elements.GetParameterValueByNameTypeOrInstance(element=window_trim, parameterName=code_block_20)
code_block_21 = CodeBlock { "Sill Height"; }
ʳʰʸᵗʰᵐ_elements_9 = Rhythm.Revit.Elements.Elements.GetParameterValueByNameTypeOrInstance(element=window_trim, parameterName=code_block_21)
list_create_4 = List.Create(item0=ʳʰʸᵗʰᵐ_elements_4, item1=ʳʰʸᵗʰᵐ_elements_5, item2=ʳʰʸᵗʰᵐ_elements_6, item3=ʳʰʸᵗʰᵐ_elements_7, item4=ʳʰʸᵗʰᵐ_elements_8, item5=ʳʰʸᵗʰᵐ_elements_9)
string_from_object_2 = FromObject(object=list_create_4)
string_3 = StringInput("")
eq_4 = string_from_object_2 == string_3
filterByBoolMask_5 = List.FilterByBoolMask(list=list_create_4, mask=eq_4)
sum = Math.Sum(values=filterByBoolMask_5.out)
sub_4 = Z_5 - sum
byCoordinates_3 = Point.ByCoordinates(x=X_5, y=Y_5, z=sub_4)

# group (continued): Get Trim
byHostAndPoint = FamilyInstance.ByHostAndPoint(familyType=type, host=firstItem, point=byCoordinates_3, lacing=Longest)
setPinnedStatus = Element.SetPinnedStatus(element=byHostAndPoint, pinned=boolean)

# group: Translate X
Z_6 = Point.Z(point=pointsAtEqualSegmentLength)
Z_7 = Point.Z(point=flatten_2)
eq_5 = Z_6 == Z_7  # lacing=Longest
filterByBoolMask_6 = List.FilterByBoolMask(list=flatten_2, mask=eq_5)
byStartPointEndPoint = Line.ByStartPointEndPoint(startPoint=filterByBoolMask_6.in, endPoint=pointsAtEqualSegmentLength)
length_3 = Curve.Length(curve=byStartPointEndPoint)
list_create_5 = List.Create(item0=length_3)
flatten_7 = List.Flatten(list=list_create_5)
code_block_22 = CodeBlock { 0; }
replaceNull = Custom[List.ReplaceNull](seq=flatten_7, replacement=code_block_22)  # package Clockwork for Dynamo 2.x; Replaces all null values within a given list with a substitute
flatten_8 = List.Flatten(list=replaceNull)
firstItem_6 = List.FirstItem(list=Z_3)
add = replaceNull + firstItem_6
code_block_23 = CodeBlock(x=flatten_8, y=add) { x>y; }
code_block_24 = CodeBlock(x=replaceNull) { -x; }
if_ = RefactoredIf(test=code_block_23, true=flatten_8, false=code_block_24, lacing=CrossProduct)

# group: Trim Height / Horizontal trim ditect
byBestFitThroughPoints_2 = Line.ByBestFitThroughPoints(bestFitPoints=flatten_2)
translate = Geometry.Translate(geometry=byBestFitThroughPoints_2, direction=reverse, distance=if_)
length_4 = Curve.Length(curve=translate)
extrude_4 = Curve.Extrude(curve=translate, direction=reverse)
translate_2 = Geometry.Translate(geometry=flatten_3, direction=reverse, distance=if_, lacing=Longest)
extrude_5 = Curve.Extrude(curve=translate_2, direction=reverse, lacing=Longest)
flatten_9 = List.Flatten(list=extrude_5)
difference_3 = Surface.Difference(surface=extrude_4, others=flatten_9)
explode_2 = Geometry.Explode(geometry=difference_3)
code_block_25 = CodeBlock { 0; }
code_block_26 = CodeBlock { 0; }
pointAtParameter_2 = Surface.PointAtParameter(surface=explode_2, u=code_block_25, v=code_block_26)
perimeter_2 = Surface.Perimeter(surface=explode_2)
code_block_27 = CodeBlock { 2; }
round_7 = Math.Round(number=perimeter_2, digits=code_block_27)
code_block_28 = CodeBlock { 2; }
sub_5 = round_7 - code_block_28
div_3 = sub_5 / code_block_28

# group: Main Trim Data
code_block_29 = CodeBlock { "Window Height"; }
ʳʰʸᵗʰᵐ_elements_10 = Rhythm.Revit.Elements.Elements.SetParameterByNameTypeOrInstance(element=byHostAndPoint, parameterName=code_block_29, value=length_4)
code_block_30 = CodeBlock { "Window Width"; }
ʳʰʸᵗʰᵐ_elements_11 = Rhythm.Revit.Elements.Elements.SetParameterByNameTypeOrInstance(element=byHostAndPoint, parameterName=code_block_30, value=length_2)

# group: Get Vertical / Horizontal Trim
string_4 = StringInput("WTS_Trim_Exterior_Window_Vertical")
byName = Family.ByName(name=string_4)
types = Family.Types(family=byName)
name_2 = Family.Name(family=types)
eq_6 = name_2 == name
filterByBoolMask_7 = List.FilterByBoolMask(list=types, mask=eq_6)
element_host_5 = Custom[Element Host](element=sortListByAnother_2.list)
byHostAndPoint_2 = FamilyInstance.ByHostAndPoint(familyType=filterByBoolMask_7.in, host=element_host_5, point=chop)
flatten_10 = List.Flatten(list=byHostAndPoint_2)
boolean_2 = BoolSelector(false)
setPinnedStatus_2 = Element.SetPinnedStatus(element=byHostAndPoint_2, pinned=boolean_2)
byHostAndPoint_3 = FamilyInstance.ByHostAndPoint(familyType=filterByBoolMask_7.in, host=element_host_5, point=pointAtParameter_2)

# group: Vertical Trims Data
code_block_31 = CodeBlock { "Trim Width"; }
ʳʰʸᵗʰᵐ_elements_12 = Rhythm.Revit.Elements.Elements.SetParameterByNameTypeOrInstance(element=flatten_10, parameterName=code_block_31, value=div_2, lacing=Longest)
code_block_32 = CodeBlock { "Thickness"; }
ʳʰʸᵗʰᵐ_elements_13 = Rhythm.Revit.Elements.Elements.SetParameterByNameTypeOrInstance(element=flatten_10, parameterName=code_block_32, value=sub_2, lacing=Longest)
code_block_33 = CodeBlock { "Window Height"; }
ʳʰʸᵗʰᵐ_elements_14 = Rhythm.Revit.Elements.Elements.SetParameterByNameTypeOrInstance(element=flatten_10, parameterName=code_block_33, value=length_4, lacing=Longest)

# group: Match Type
ʳʰʸᵗʰᵐ_elements_15 = Rhythm.Revit.Elements.Elements.GetParameterValueByNameTypeOrInstance(element=window_trim, parameterName=watch_5)
watch_6 = Watch(ʳʰʸᵗʰᵐ_elements_15)
ʳʰʸᵗʰᵐ_elements_16 = Rhythm.Revit.Elements.Elements.SetParameterByNameTypeOrInstance(element=byHostAndPoint, parameterName=watch_5, value=ʳʰʸᵗʰᵐ_elements_15, lacing=Longest)

# group: Horizontal Trims Data
code_block_34 = CodeBlock { "Trim Width"; }
ʳʰʸᵗʰᵐ_elements_17 = Rhythm.Revit.Elements.Elements.SetParameterByNameTypeOrInstance(element=byHostAndPoint_3, parameterName=code_block_34, value=length_2, lacing=Longest)
code_block_35 = CodeBlock { "Thickness"; }
ʳʰʸᵗʰᵐ_elements_18 = Rhythm.Revit.Elements.Elements.SetParameterByNameTypeOrInstance(element=byHostAndPoint_3, parameterName=code_block_35, value=sub_2, lacing=Longest)
code_block_36 = CodeBlock { "Window Height"; }
ʳʰʸᵗʰᵐ_elements_19 = Rhythm.Revit.Elements.Elements.SetParameterByNameTypeOrInstance(element=byHostAndPoint_3, parameterName=code_block_36, value=div_3, lacing=Longest)

# group: Join Trims
flatten_11 = List.Flatten(list=ʳʰʸᵗʰᵐ_elements_14, lacing=CrossProduct)
flatten_12 = List.Flatten(list=ʳʰʸᵗʰᵐ_elements_19)
code_block_37 = CodeBlock { 1; }
chop_2 = List.Chop(list=flatten_12, lengths=code_block_37)
joinGeometry = Custom[Element.JoinGeometry](element1=flatten_11, element2=chop_2, lacing=CrossProduct)  # package Clockwork for Dynamo 2.x; Joins two model elements (if possible). Only works inside the project environment.
