# Dynamo graph Auto Trims  s v 1.02 .dyn "Auto Trims s v 1.02" (Dynamo 2.16.2.5624)
# author: Yousef Altear
# packages: Rhythm 2023.9.1, archi-lab.net 2024.217.1024, Genius Loci 2023.7.13, GenerativeDesign.Revit 3.0.16.0

# group: Auto Window Trim
# note: Ⓒ Copyright of Script to Paragons Egypt Team

# group: Get Trim
window_trim = DSModelElementSelection()  # 1 picked in the model; graph input
type = archilab.Revit.Elements.Elements.Type(element=window_trim)
element_host = Custom[Element Host]()  # package Genius Loci; Gets the host of the element. Unlike the OOTB node FamilyInstance.GetHost, it also works for elements hosted by a linked document, wall sweeps, foundations, railings and builing pads. Based on a Clockwork's node; unwired: element
firstItem = List.FirstItem(list=element_host)
parameters = Element.Parameters(element=window_trim)
watch = Watch(parameters)
parameters_2 = Element.Parameters(element=type)
watch_2 = Watch(parameters_2)
number = DoubleInput(11)
getItemAtIndex = List.GetItemAtIndex(list=watch_2, index=number)
name = Family.Name(family=window_trim)

# group: Point Creator
X = Point.X()  # unwired: point
Y = Point.Y()  # unwired: point
Z = Point.Z()  # unwired: point
code_block = CodeBlock { "Lower Horizontal Trim Width"; }
ʳʰʸᵗʰᵐ_elements = Rhythm.Revit.Elements.Elements.GetParameterValueByNameTypeOrInstance(element=window_trim, parameterName=code_block)
code_block_2 = CodeBlock { "Sill Bottom Height"; }
ʳʰʸᵗʰᵐ_elements_2 = Rhythm.Revit.Elements.Elements.GetParameterValueByNameTypeOrInstance(element=window_trim, parameterName=code_block_2)
code_block_3 = CodeBlock { "Sill Thickness"; }
ʳʰʸᵗʰᵐ_elements_3 = Rhythm.Revit.Elements.Elements.GetParameterValueByNameTypeOrInstance(element=window_trim, parameterName=code_block_3)
code_block_4 = CodeBlock { "Bottom Sill Offset"; }
ʳʰʸᵗʰᵐ_elements_4 = Rhythm.Revit.Elements.Elements.GetParameterValueByNameTypeOrInstance(element=window_trim, parameterName=code_block_4)
code_block_5 = CodeBlock { "Bottom Sill Width"; }
ʳʰʸᵗʰᵐ_elements_5 = Rhythm.Revit.Elements.Elements.GetParameterValueByNameTypeOrInstance(element=window_trim, parameterName=code_block_5)
code_block_6 = CodeBlock { "Trim Width"; }
ʳʰʸᵗʰᵐ_elements_6 = Rhythm.Revit.Elements.Elements.GetParameterValueByNameTypeOrInstance(element=window_trim, parameterName=code_block_6)
list_create = List.Create(item0=ʳʰʸᵗʰᵐ_elements, item1=ʳʰʸᵗʰᵐ_elements_2, item2=ʳʰʸᵗʰᵐ_elements_3, item3=ʳʰʸᵗʰᵐ_elements_4, item4=ʳʰʸᵗʰᵐ_elements_5, item5=ʳʰʸᵗʰᵐ_elements_6)
string_from_object = FromObject(object=list_create)
string = StringInput("")
eq = string_from_object == string
filterByBoolMask = List.FilterByBoolMask(list=list_create, mask=eq)
sum = Math.Sum(values=filterByBoolMask.out)
sub = Z - sum
byCoordinates = Point.ByCoordinates(x=X, y=Y, z=sub)

# group (continued): Get Trim
byHostAndPoint = FamilyInstance.ByHostAndPoint(familyType=type, host=firstItem, point=byCoordinates, lacing=Longest)

# group: Trims Data
code_block_7 = CodeBlock { "Window Height"; }
ʳʰʸᵗʰᵐ_elements_7 = Rhythm.Revit.Elements.Elements.SetParameterByNameTypeOrInstance(element=byHostAndPoint, parameterName=code_block_7)  # unwired: value
code_block_8 = CodeBlock { "Window Width"; }
ʳʰʸᵗʰᵐ_elements_8 = Rhythm.Revit.Elements.Elements.SetParameterByNameTypeOrInstance(element=byHostAndPoint, parameterName=code_block_8)  # unwired: value

# group: Family Data
parameters_3 = Element.Parameters()  # unwired: element
watch_3 = Watch(parameters_3)
type_2 = archilab.Revit.Elements.Elements.Type()  # unwired: element
parameters_4 = Element.Parameters(element=type_2)
watch_4 = Watch(parameters_4)

# group: Get Window
s_w_single_windows = DSModelElementMutlipleSelection()  # 7 picked in the model; graph input

# group: Point Creator
getLocation = Element.GetLocation(element=s_w_single_windows)
X_2 = Point.X(point=getLocation)
Y_2 = Point.Y(point=getLocation)
Z_2 = Point.Z(point=getLocation)
sub_2 = Z_2 - sum
byCoordinates_2 = Point.ByCoordinates(x=X_2, y=Y_2, z=sub_2)

# group: Get Trim
element_host_2 = Custom[Element Host](element=s_w_single_windows)
byHostAndPoint_2 = FamilyInstance.ByHostAndPoint(familyType=type, host=element_host_2, point=byCoordinates_2, lacing=Longest)

# group: Window Data
code_block_9 = CodeBlock { "Height"; }
ʳʰʸᵗʰᵐ_elements_9 = Rhythm.Revit.Elements.Elements.GetParameterValueByNameTypeOrInstance(element=s_w_single_windows, parameterName=code_block_9)
watch_5 = Watch(ʳʰʸᵗʰᵐ_elements_9)
code_block_10 = CodeBlock { "Width"; }
ʳʰʸᵗʰᵐ_elements_10 = Rhythm.Revit.Elements.Elements.GetParameterValueByNameTypeOrInstance(element=s_w_single_windows, parameterName=code_block_10)
watch_6 = Watch(ʳʰʸᵗʰᵐ_elements_10)

# group: Trims Data
code_block_11 = CodeBlock { "Window Height"; }
ʳʰʸᵗʰᵐ_elements_11 = Rhythm.Revit.Elements.Elements.SetParameterByNameTypeOrInstance(element=byHostAndPoint_2, parameterName=code_block_11, value=watch_5)
code_block_12 = CodeBlock { "Window Width"; }
ʳʰʸᵗʰᵐ_elements_12 = Rhythm.Revit.Elements.Elements.SetParameterByNameTypeOrInstance(element=byHostAndPoint_2, parameterName=code_block_12, value=watch_6)
