# Dynamo graph Auto Trims  s v 1.1 mirror .dyn "Auto Trims s v 1.1 mirror" (Dynamo 2.16.2.5624)
# author: Yousef Altear
# packages: archi-lab.net 2024.217.1024, Rhythm 2023.9.1, Genius Loci 2023.7.13, GenerativeDesign.Revit 3.0.16.0, Clockwork for Dynamo 2.x 2.6.0, bimorphNodes 5.1.3

# group: Auto Window Trim
# note: Ⓒ Copyright of Script to Paragons Egypt Team

# group: Get Window
s_w_d_single_windows_doors = DSModelElementMutlipleSelection()  # 1 picked in the model; graph input

# group: Get Trim
window_trim = DSModelElementSelection()  # 1 picked in the model; graph input
type = archilab.Revit.Elements.Elements.Type(element=window_trim)
element_host = Custom[Element Host](element=s_w_d_single_windows_doors)  # package Genius Loci; Gets the host of the element. Unlike the OOTB node FamilyInstance.GetHost, it also works for elements hosted by a linked document, wall sweeps, foundations, railings and builing pads. Based on a Clockwork's node
code_block = CodeBlock { 1; }

# group: Point Creator
getLocation = Element.GetLocation(element=s_w_d_single_windows_doors)
X = Point.X(point=getLocation)
Y = Point.Y(point=getLocation)
Z = Point.Z(point=getLocation)
code_block_2 = CodeBlock { "Lower Horizontal Trim Width"; }
ʳʰʸᵗʰᵐ_elements = Rhythm.Revit.Elements.Elements.GetParameterValueByNameTypeOrInstance(element=window_trim, parameterName=code_block_2)
code_block_3 = CodeBlock { "Sill Bottom Height"; }
ʳʰʸᵗʰᵐ_elements_2 = Rhythm.Revit.Elements.Elements.GetParameterValueByNameTypeOrInstance(element=window_trim, parameterName=code_block_3)
code_block_4 = CodeBlock { "Sill Thickness"; }
ʳʰʸᵗʰᵐ_elements_3 = Rhythm.Revit.Elements.Elements.GetParameterValueByNameTypeOrInstance(element=window_trim, parameterName=code_block_4)
code_block_5 = CodeBlock { "Bottom Sill Offset"; }
ʳʰʸᵗʰᵐ_elements_4 = Rhythm.Revit.Elements.Elements.GetParameterValueByNameTypeOrInstance(element=window_trim, parameterName=code_block_5)
code_block_6 = CodeBlock { "Bottom Sill Width"; }
ʳʰʸᵗʰᵐ_elements_5 = Rhythm.Revit.Elements.Elements.GetParameterValueByNameTypeOrInstance(element=window_trim, parameterName=code_block_6)
code_block_7 = CodeBlock { "Trim Width"; }
ʳʰʸᵗʰᵐ_elements_6 = Rhythm.Revit.Elements.Elements.GetParameterValueByNameTypeOrInstance(element=window_trim, parameterName=code_block_7)
list_create = List.Create(item0=ʳʰʸᵗʰᵐ_elements, item1=ʳʰʸᵗʰᵐ_elements_2, item2=ʳʰʸᵗʰᵐ_elements_3, item3=ʳʰʸᵗʰᵐ_elements_4, item4=ʳʰʸᵗʰᵐ_elements_5, item5=ʳʰʸᵗʰᵐ_elements_6)
string_from_object = FromObject(object=list_create)
string = StringInput("")
eq = string_from_object == string
filterByBoolMask = List.FilterByBoolMask(list=list_create, mask=eq)
sum = Math.Sum(values=filterByBoolMask.out)
sub = Z - sum

# group: If Condetion
elementType = Revit.LinkElement.ElementType(linkElement=s_w_d_single_windows_doors)
string_from_object_2 = FromObject(object=elementType)
code_block_8 = CodeBlock { "Door"; }
contains = String.Contains(string=string_from_object_2, searchFor=code_block_8)
countTrue = List.CountTrue(list=contains)
code_block_9 = CodeBlock { 1; }
code_block_10 = CodeBlock(x=countTrue, y=code_block_9) { x>=y; }
if_ = RefactoredIf(test=code_block_10, true=Z, false=sub)

# group (continued): Point Creator
byCoordinates = Point.ByCoordinates(x=X, y=Y, z=if_)

# group (continued): Get Trim
byHostAndPoint = FamilyInstance.ByHostAndPoint(familyType=type, host=element_host, point=byCoordinates)

# group: Family Data
parameters = Element.Parameters(element=window_trim)
watch = Watch(parameters)
type_2 = archilab.Revit.Elements.Elements.Type(element=window_trim)
parameters_2 = Element.Parameters(element=type_2)
watch_2 = Watch(parameters_2)

# group: Match Properties
string_from_object_3 = FromObject(object=watch)
string_2 = StringInput(":")
lastIndexOf = String.LastIndexOf(string=string_from_object_3, searchFor=string_2)
length = String.Length(string=string_from_object_3)
sub_2 = length - lastIndexOf
substring = String.Substring(string=string_from_object_3, startIndex=lastIndexOf, length=sub_2)
string_3 = StringInput("")
replace = String.Replace(string=string_from_object_3, searchFor=substring, replaceWith=string_3)
trimTrailingWhitespace = String.TrimTrailingWhitespace(string=replace)
code_block_11 = CodeBlock()
# ---------- code_block_11.designscript (35 lines) ----------
"Area";
"Category";
"Comments";
"Design Option";
"Documentation : https";
"Elevation from Level";
"Export to IFC";
"Export to IFC As";
"Family";
"Family and Type : WTS_Trim_Interior_Window_Flat_Header";
"Family Name";
"Host Id";
"hsbcad Assembly Name";
"hsbcad Beam Code";
"hsbcad Beam Id";
"hsbcad Beam Type";
"hsbcad Element Type";
"hsbcad Item Container Name";
"hsbcad Module";
"hsbcad Panel Number";
"hsbcad Posnum";
"hsbcad Weight";
"IFC Predefined Type";
"IfcGUID";
"Image";
"Level";
"Mark";
"Phase Created";
"Phase Demolished";
"Type";
"Type Id";
"Type Name";
"Volume";
"Window Height";
"Window Width";
# ----------------------------------------
list_create_2 = List.Create(item0=code_block_11.out0, item1=code_block_11.out1, item2=code_block_11.out2, item3=code_block_11.out3, item4=code_block_11.out4, item5=code_block_11.out5, item6=code_block_11.out6, item7=code_block_11.out7, item8=code_block_11.out8, item9=code_block_11.out9, item10=code_block_11.out10, item11=code_block_11.out11, item12=code_block_11.out12, item13=code_block_11.out13, item14=code_block_11.out14, item15=code_block_11.out15, item16=code_block_11.out16, item17=code_block_11.out17, item18=code_block_11.out18, item19=code_block_11.out19, item20=code_block_11.out20, item21=code_block_11.out21, item22=code_block_11.out22, item23=code_block_11.out23, item24=code_block_11.out24, item25=code_block_11.out25, item26=code_block_11.out26, item27=code_block_11.out27, item28=code_block_11.out28, item29=code_block_11.out29, item30=code_block_11.out30, item31=code_block_11.out31, item32=code_block_11.out32, item33=code_block_11.out33, item34=code_block_11.out34)
contains_2 = String.Contains(string=trimTrailingWhitespace, searchFor=list_create_2, lacing=CrossProduct)
anyTrue = Custom[Booleans.AnyTrue](seq=contains_2)  # package Clockwork for Dynamo 2.x; Returns true if any item in a list of booleans is true. ATTENTION: This node will be deprecated in 2024. As of Revit 2022, please switch to the OOTB node AnyTrue.
filterByBoolMask_2 = List.FilterByBoolMask(list=trimTrailingWhitespace, mask=anyTrue)
watch_3 = Watch(filterByBoolMask_2.out)

# group: Match Type
firstItem = List.FirstItem(list=byHostAndPoint)
code_block_12 = CodeBlock { 1; }
chop = List.Chop(list=watch_3, lengths=code_block_12, lacing=CrossProduct)
ʳʰʸᵗʰᵐ_elements_7 = Rhythm.Revit.Elements.Elements.GetParameterValueByNameTypeOrInstance(element=window_trim, parameterName=watch_3, lacing=Longest)
code_block_13 = CodeBlock { 1; }
chop_2 = List.Chop(list=ʳʰʸᵗʰᵐ_elements_7, lengths=code_block_13, lacing=CrossProduct)
ʳʰʸᵗʰᵐ_elements_8 = Rhythm.Revit.Elements.Elements.SetParameterByNameTypeOrInstance(element=firstItem, parameterName=chop, value=chop_2, lacing=Longest)
watch_4 = Watch(ʳʰʸᵗʰᵐ_elements_7)

# group: MATCH
code_block_14 = CodeBlock { 3; }
getItemAtIndex = List.GetItemAtIndex(list=byHostAndPoint, index=code_block_14)
code_block_15 = CodeBlock { 4; }
getItemAtIndex_2 = List.GetItemAtIndex(list=byHostAndPoint, index=code_block_15)
code_block_16 = CodeBlock { 5; }
getItemAtIndex_3 = List.GetItemAtIndex(list=byHostAndPoint, index=code_block_16)
code_block_17 = CodeBlock { 6; }
getItemAtIndex_4 = List.GetItemAtIndex(list=byHostAndPoint, index=code_block_17)
code_block_18 = CodeBlock { 7; }
getItemAtIndex_5 = List.GetItemAtIndex(list=byHostAndPoint, index=code_block_18)
code_block_19 = CodeBlock { 8; }
getItemAtIndex_6 = List.GetItemAtIndex(list=byHostAndPoint, index=code_block_19)
code_block_20 = CodeBlock { 9; }
getItemAtIndex_7 = List.GetItemAtIndex(list=byHostAndPoint, index=code_block_20)
code_block_21 = CodeBlock { 10; }
getItemAtIndex_8 = List.GetItemAtIndex(list=byHostAndPoint, index=code_block_21)
code_block_22 = CodeBlock { 11; }
getItemAtIndex_9 = List.GetItemAtIndex(list=byHostAndPoint, index=code_block_22)
code_block_23 = CodeBlock { 1; }
getItemAtIndex_10 = List.GetItemAtIndex(list=byHostAndPoint, index=code_block_23)
code_block_24 = CodeBlock { 2; }
getItemAtIndex_11 = List.GetItemAtIndex(list=byHostAndPoint, index=code_block_24)
code_block_25 = CodeBlock { 12; }
getItemAtIndex_12 = List.GetItemAtIndex(list=byHostAndPoint, index=code_block_25)
code_block_26 = CodeBlock { 13; }
getItemAtIndex_13 = List.GetItemAtIndex(list=byHostAndPoint, index=code_block_26)
code_block_27 = CodeBlock { 14; }
getItemAtIndex_14 = List.GetItemAtIndex(list=byHostAndPoint, index=code_block_27)
code_block_28 = CodeBlock { 15; }
getItemAtIndex_15 = List.GetItemAtIndex(list=byHostAndPoint, index=code_block_28)
code_block_29 = CodeBlock { 16; }
getItemAtIndex_16 = List.GetItemAtIndex(list=byHostAndPoint, index=code_block_29)
code_block_30 = CodeBlock { 17; }
getItemAtIndex_17 = List.GetItemAtIndex(list=byHostAndPoint, index=code_block_30)
code_block_31 = CodeBlock { 18; }
getItemAtIndex_18 = List.GetItemAtIndex(list=byHostAndPoint, index=code_block_31)
code_block_32 = CodeBlock { 19; }
getItemAtIndex_19 = List.GetItemAtIndex(list=byHostAndPoint, index=code_block_32)
code_block_33 = CodeBlock { 20; }
getItemAtIndex_20 = List.GetItemAtIndex(list=byHostAndPoint, index=code_block_33)

# group: PROPERTIES
ʳʰʸᵗʰᵐ_elements_9 = Rhythm.Revit.Elements.Elements.SetParameterByNameTypeOrInstance(element=getItemAtIndex, parameterName=chop, value=chop_2, lacing=Longest)
ʳʰʸᵗʰᵐ_elements_10 = Rhythm.Revit.Elements.Elements.SetParameterByNameTypeOrInstance(element=getItemAtIndex_2, parameterName=chop, value=chop_2, lacing=Longest)
ʳʰʸᵗʰᵐ_elements_11 = Rhythm.Revit.Elements.Elements.SetParameterByNameTypeOrInstance(element=getItemAtIndex_3, parameterName=chop, value=chop_2, lacing=Longest)
ʳʰʸᵗʰᵐ_elements_12 = Rhythm.Revit.Elements.Elements.SetParameterByNameTypeOrInstance(element=getItemAtIndex_4, parameterName=chop, value=chop_2, lacing=Longest)
ʳʰʸᵗʰᵐ_elements_13 = Rhythm.Revit.Elements.Elements.SetParameterByNameTypeOrInstance(element=getItemAtIndex_5, parameterName=chop, value=chop_2, lacing=Longest)
ʳʰʸᵗʰᵐ_elements_14 = Rhythm.Revit.Elements.Elements.SetParameterByNameTypeOrInstance(element=getItemAtIndex_6, parameterName=chop, value=chop_2, lacing=Longest)
ʳʰʸᵗʰᵐ_elements_15 = Rhythm.Revit.Elements.Elements.SetParameterByNameTypeOrInstance(element=getItemAtIndex_7, parameterName=chop, value=chop_2, lacing=Longest)
ʳʰʸᵗʰᵐ_elements_16 = Rhythm.Revit.Elements.Elements.SetParameterByNameTypeOrInstance(element=getItemAtIndex_8, parameterName=chop, value=chop_2, lacing=Longest)
ʳʰʸᵗʰᵐ_elements_17 = Rhythm.Revit.Elements.Elements.SetParameterByNameTypeOrInstance(element=getItemAtIndex_9, parameterName=chop, value=chop_2, lacing=Longest)
ʳʰʸᵗʰᵐ_elements_18 = Rhythm.Revit.Elements.Elements.SetParameterByNameTypeOrInstance(element=getItemAtIndex_10, parameterName=chop, value=chop_2, lacing=Longest)
ʳʰʸᵗʰᵐ_elements_19 = Rhythm.Revit.Elements.Elements.SetParameterByNameTypeOrInstance(element=getItemAtIndex_11, parameterName=chop, value=chop_2, lacing=Longest)
ʳʰʸᵗʰᵐ_elements_20 = Rhythm.Revit.Elements.Elements.SetParameterByNameTypeOrInstance(element=getItemAtIndex_12, parameterName=chop, value=chop_2, lacing=Longest)
ʳʰʸᵗʰᵐ_elements_21 = Rhythm.Revit.Elements.Elements.SetParameterByNameTypeOrInstance(element=getItemAtIndex_13, parameterName=chop, value=chop_2, lacing=Longest)
ʳʰʸᵗʰᵐ_elements_22 = Rhythm.Revit.Elements.Elements.SetParameterByNameTypeOrInstance(element=getItemAtIndex_14, parameterName=chop, value=chop_2, lacing=Longest)
ʳʰʸᵗʰᵐ_elements_23 = Rhythm.Revit.Elements.Elements.SetParameterByNameTypeOrInstance(element=getItemAtIndex_15, parameterName=chop, value=chop_2, lacing=Longest)
ʳʰʸᵗʰᵐ_elements_24 = Rhythm.Revit.Elements.Elements.SetParameterByNameTypeOrInstance(element=getItemAtIndex_16, parameterName=chop, value=chop_2, lacing=Longest)
ʳʰʸᵗʰᵐ_elements_25 = Rhythm.Revit.Elements.Elements.SetParameterByNameTypeOrInstance(element=getItemAtIndex_17, parameterName=chop, value=chop_2, lacing=Longest)
ʳʰʸᵗʰᵐ_elements_26 = Rhythm.Revit.Elements.Elements.SetParameterByNameTypeOrInstance(element=getItemAtIndex_18, parameterName=chop, value=chop_2, lacing=Longest)
ʳʰʸᵗʰᵐ_elements_27 = Rhythm.Revit.Elements.Elements.SetParameterByNameTypeOrInstance(element=getItemAtIndex_19, parameterName=chop, value=chop_2, lacing=Longest)
ʳʰʸᵗʰᵐ_elements_28 = Rhythm.Revit.Elements.Elements.SetParameterByNameTypeOrInstance(element=getItemAtIndex_20, parameterName=chop, value=chop_2, lacing=Longest)

# group: Door Data
code_block_34 = CodeBlock { "Rough Width"; }
ʳʰʸᵗʰᵐ_elements_29 = Rhythm.Revit.Elements.Elements.GetParameterValueByNameTypeOrInstance(element=s_w_d_single_windows_doors, parameterName=code_block_34)
watch_5 = Watch(ʳʰʸᵗʰᵐ_elements_29)
code_block_35 = CodeBlock { "Rough Height"; }
ʳʰʸᵗʰᵐ_elements_30 = Rhythm.Revit.Elements.Elements.GetParameterValueByNameTypeOrInstance(element=s_w_d_single_windows_doors, parameterName=code_block_35)
watch_6 = Watch(ʳʰʸᵗʰᵐ_elements_30)

# group: Trims Data
code_block_36 = CodeBlock { 2; }
code_block_37 = CodeBlock { "Door Width"; }
ʳʰʸᵗʰᵐ_elements_31 = Rhythm.Revit.Elements.Elements.SetParameterByNameTypeOrInstance(element=byHostAndPoint, parameterName=code_block_37, value=watch_5)
code_block_38 = CodeBlock { "Door Height"; }
ʳʰʸᵗʰᵐ_elements_32 = Rhythm.Revit.Elements.Elements.SetParameterByNameTypeOrInstance(element=byHostAndPoint, parameterName=code_block_38, value=watch_6)

# group: Window Data
code_block_39 = CodeBlock { "Width"; }
ʳʰʸᵗʰᵐ_elements_33 = Rhythm.Revit.Elements.Elements.GetParameterValueByNameTypeOrInstance(element=s_w_d_single_windows_doors, parameterName=code_block_39)
watch_7 = Watch(ʳʰʸᵗʰᵐ_elements_33)
code_block_40 = CodeBlock { "Height"; }
ʳʰʸᵗʰᵐ_elements_34 = Rhythm.Revit.Elements.Elements.GetParameterValueByNameTypeOrInstance(element=s_w_d_single_windows_doors, parameterName=code_block_40)
watch_8 = Watch(ʳʰʸᵗʰᵐ_elements_34)

# group: Trims Data
code_block_41 = CodeBlock { "Window Width"; }
ʳʰʸᵗʰᵐ_elements_35 = Rhythm.Revit.Elements.Elements.SetParameterByNameTypeOrInstance(element=byHostAndPoint, parameterName=code_block_41, value=watch_7)
code_block_42 = CodeBlock { "Window Height"; }
ʳʰʸᵗʰᵐ_elements_36 = Rhythm.Revit.Elements.Elements.SetParameterByNameTypeOrInstance(element=byHostAndPoint, parameterName=code_block_42, value=watch_8)

element_host_2 = Custom[Element Host](element=s_w_d_single_windows_doors)
getLocation_2 = Element.GetLocation(element=element_host_2)
startPoint = Curve.StartPoint(curve=getLocation_2)
endPoint = Curve.EndPoint(curve=getLocation_2)
code_block_43 = CodeBlock { 0.5; }
pointAtParameter = Curve.PointAtParameter(curve=getLocation_2, param=code_block_43)
X_2 = Point.X(point=pointAtParameter)
Y_2 = Point.Y(point=pointAtParameter)
code_block_44 = CodeBlock { 3; }
byCoordinates_2 = Point.ByCoordinates(x=X_2, y=Y_2, z=code_block_44)
list_create_3 = List.Create(item0=startPoint, item1=endPoint, item2=byCoordinates_2)
byBestFitThroughPoints = Plane.ByBestFitThroughPoints(points=list_create_3)
mirror = Geometry.Mirror(geometry=byHostAndPoint, mirrorPlane=byBestFitThroughPoints)
code_block_45 = CodeBlock { 2; 3; 5; }
byCoordinates_3 = Point.ByCoordinates(x=code_block_45.out2, y=code_block_45.out1, z=code_block_45.out0)
byCoordinates_4 = Point.ByCoordinates(x=code_block_45.out0, y=code_block_45.out1, z=code_block_45.out2)
byTwoPoints = Vector.ByTwoPoints(start=byCoordinates_3, end=byCoordinates_4)
byStartPointEndPoint = Line.ByStartPointEndPoint(startPoint=byCoordinates_4, endPoint=byCoordinates_3)
